# Dynamo graph PGS_ADSK_Квартирография_ActiveView.dyn (Dynamo 2.10.1.3976)

# note: Описание проекта и назначение программы Dynamo

# group: ИМПОРТ
# note: Используйте этот цвет группы для узлов, применяемых с целью импорта геометрии.

# group: ВЫВОД
# note: Используйте этот цвет группы для узлов, применяемых с целью создания элементов Revit.

# group: PYTHON
# note: Используйте этот цвет группы для узлов Python и других узлов, связанных со сценарием.

# group: ВХОДНЫЕ ДАННЫЕ
# note: Используйте этот цвет группы для входных данных программ (регуляторы, блоки кода и т.д.).

# group: ПРОЕКТ
# note: Используйте этот цвет группы для функций программы.

перезапуск_скрипта = BoolSelector(true)  # graph input

# group: Расчет
python_script = Python(IN[0]=перезапуск_скрипта)  # IronPython2
# ---------- python_script.python (207 lines) ----------
# Подключение библиотек
import clr

clr.AddReference('ProtoGeometry')
from Autodesk.DesignScript.Geometry import *

clr.AddReference('RevitAPI')
from Autodesk.Revit.DB import *

clr.AddReference("RevitServices")
import RevitServices
from RevitServices.Persistence import DocumentManager
from RevitServices.Transactions import TransactionManager

doc = DocumentManager.Instance.CurrentDBDocument
currentView = doc.ActiveView
# --------------Взятие элементов------------------------
rooms = FilteredElementCollector(doc, currentView.Id).OfCategory(BuiltInCategory.OST_Rooms).WhereElementIsNotElementType().ToElements()
# Ссылка на BuiltInCategories: http://www.revitapidocs.com/2018.1/ba1c5b30-242f-5fdc-8ea9-ec3b61e6e722.htm

# --------------Входные данные--------------------
# ОСНОВНАЯ ЧАСТЬ КОДА

# Присвоение параметров помещениям

list1 = []
list2 = []
TransactionManager.Instance.EnsureInTransaction(doc)
for room in rooms:
    value = room.LookupParameter("Имя").AsString().ToLower()
    value2 = room.LookupParameter("ADSK_Номер квартиры").AsString()
    value3 = room.LookupParameter("Площадь").AsValueString()
    value4 = room.LookupParameter("Комментарии").AsString()
    value5 = room.LookupParameter("ADSK_Тип помещения").AsInteger()
    value6 = room.LookupParameter("ADSK_Количество комнат").AsDouble()
    type1 = ["комната", "гостиная", "спальня", "мастер-спальня"]
    type2 = ["кухня", "столовая", "с.у.", "с/у", "ванная с санузом", "санузел", "ванная", "душевая",
             "офисное помещение", "богодельня", "холл", "коридор", "прихожая", "гардероб", "тамбур", "лестница",
             "кухня-столовая", "тамбур-шлюз", "гард."]
    type3 = ["лоджия"]
    type4 = ["балкон", "терраса"]
    type5 = ["вестибюль", "лестничная клетка", "лифтовая шахта", "лифтовый холл"]
    list1.append(value5)
    list2.append(value2)
    if "нежилая" == value4:
        room.LookupParameter("ADSK_Тип помещения").Set(2)
        room.LookupParameter("ADSK_Коэффициент площади").Set(1)
    elif "общий" == value4:
        room.LookupParameter("ADSK_Тип помещения").Set(5)
        room.LookupParameter("ADSK_Коэффициент площади").Set(1)
    elif "кухня-гостиная" in value:
        room.LookupParameter("ADSK_Тип помещения").Set(1)
        room.LookupParameter("ADSK_Коэффициент площади").Set(1)
    elif value in type2:
        room.LookupParameter("ADSK_Тип помещения").Set(2)
        room.LookupParameter("ADSK_Коэффициент площади").Set(1)
    elif value in type1:
        room.LookupParameter("ADSK_Тип помещения").Set(1)
        room.LookupParameter("ADSK_Коэффициент площади").Set(1)
    elif value in type3:
        room.LookupParameter("ADSK_Тип помещения").Set(3)
        room.LookupParameter("ADSK_Коэффициент площади").Set(0.5)
    elif value in type4:
        room.LookupParameter("ADSK_Тип помещения").Set(4)
        room.LookupParameter("ADSK_Коэффициент площади").Set(0.3)
    elif value in type5:
        room.LookupParameter("ADSK_Тип помещения").Set(5)
        room.LookupParameter("ADSK_Коэффициент площади").Set(1)
    else:
        value


# Получение списка уникальных номеров квартир в проекте
def get_unique_numbers(list2):
    list_of_unique = []
    unique_numbers = set(list2)
    for number in unique_numbers:
        list_of_unique.append(number)
    return list_of_unique


# Готовый список уникальных номеров квартир
apartments = get_unique_numbers(list2)

# Количество жилых комнат по квартирам
rooms_liv_count = []
for apartment in apartments:
    rooms_liv = []
    for room in rooms:
        if (room.LookupParameter("ADSK_Номер квартиры").AsString() == str(apartment) and room.LookupParameter(
                "ADSK_Тип помещения").AsInteger() == 1):
            rooms_liv.append(room)
    count = len(rooms_liv)
    rooms_liv_count.append(count)

# Создание словаря количества жилых комнат на основе номеров квартир
dictionary = dict(zip(apartments, rooms_liv_count))

# Назначение параметра количества жилых комнат жилым помещениям
rooms_living = []
for room in rooms:
    if room.LookupParameter("ADSK_Тип помещения").AsInteger() == 1:
        rooms_living.append(room)
    apartment_number = room.LookupParameter("ADSK_Номер квартиры").AsString()
    room.LookupParameter("ADSK_Количество комнат").Set(dictionary.get(apartment_number))

# получение жилой площади квартир

################################################################################

# Список всех жилых помещений в проекте
all_liv_rooms = []
for room in rooms:
    if room.LookupParameter("ADSK_Тип помещения").AsInteger() == 1:
        all_liv_rooms.append(room)

# Список жилой площади квартир
areas_list = []
for apartment in apartments:
    one_apartment_area = 0
    for room in all_liv_rooms:
        if room.LookupParameter("ADSK_Номер квартиры").AsString() == str(apartment):
            room_area = room.LookupParameter("Площадь").AsDouble() * (0.3048 ** 2)
            one_apartment_area = one_apartment_area + room_area
    areas_list.append(one_apartment_area)

# Словарь номеров квартир и площади жилых помещений
dictionary_liv = dict(zip(apartments, areas_list))

# Назначение жилой площади к помещениям в квартирах
for room in all_liv_rooms:
    apartment_number = room.LookupParameter("ADSK_Номер квартиры").AsString()
    dict_liv = dictionary_liv.get(apartment_number) / (0.3048 ** 2)
    room.LookupParameter("ADSK_Площадь квартиры жилая").Set(dict_liv)

# Список жилых и нежилых помещений
all_unliv_rooms = []
for room in rooms:
    if room.LookupParameter("ADSK_Тип помещения").AsInteger() < 3:
        all_unliv_rooms.append(room)

# Список общих площадей квартир
areas_unliv_list = []
for apartment in apartments:
    one_apartment_unliv_area = 0
    for room in all_unliv_rooms:
        if room.LookupParameter("ADSK_Номер квартиры").AsString() == str(apartment):
            room_unliv_area = room.LookupParameter("Площадь").AsDouble() * (0.3048 ** 2)
            one_apartment_unliv_area = one_apartment_unliv_area + room_unliv_area
    areas_unliv_list.append(one_apartment_unliv_area)

# Словарь номеров квартир и площади жилых и нежилых помещений
dictionary_unliv = dict(zip(apartments, areas_unliv_list))

# Назначение общей площади к помещениям в квартирах
for room in all_unliv_rooms:
    apartment_number = room.LookupParameter("ADSK_Номер квартиры").AsString()
    dict_unliv = dictionary_unliv.get(apartment_number) / (0.3048 ** 2)
    room.LookupParameter("ADSK_Площадь квартиры").Set(dict_unliv)

# Список площадей из типов помещений 3,4,5
areas_unliv_cold_rooms_list = []
for apartment in apartments:
    one_apartment_balkon_area = 0
    one_apartment_lodj_area = 0
    one_apartment_totalFive_area = 0
    one_apartment_coldtotal_area = 0
    for room in rooms:
        if room.LookupParameter("ADSK_Номер квартиры").AsString() == str(apartment) and room.LookupParameter(
                "ADSK_Тип помещения").AsInteger() == 3:
            room_lodj_area = (room.LookupParameter("Площадь").AsDouble() * (0.3048 ** 2)) * room.LookupParameter(
                "ADSK_Коэффициент площади").AsDouble()
            one_apartment_lodj_area = one_apartment_lodj_area + room_lodj_area
        elif room.LookupParameter("ADSK_Номер квартиры").AsString() == str(apartment) and room.LookupParameter(
                "ADSK_Тип помещения").AsInteger() == 4:
            room_balkon_area = (room.LookupParameter("Площадь").AsDouble() * (0.3048 ** 2)) * room.LookupParameter(
                "ADSK_Коэффициент площади").AsDouble()
            one_apartment_balkon_area = one_apartment_balkon_area + room_balkon_area
        elif room.LookupParameter("ADSK_Номер квартиры").AsString() == str(apartment) and room.LookupParameter(
                "ADSK_Тип помещения").AsInteger() == 5:
            room_totals_area = (room.LookupParameter("Площадь").AsDouble() * (0.3048 ** 2)) * room.LookupParameter(
                "ADSK_Коэффициент площади").AsDouble()
            one_apartment_totalFive_area = one_apartment_totalFive_area + room_totals_area
        one_apartment_coldtotal_area = one_apartment_lodj_area + one_apartment_balkon_area + one_apartment_totalFive_area
    areas_unliv_cold_rooms_list.append(one_apartment_coldtotal_area)
#
areas_total_list = []
count_of_apartments = len(areas_unliv_list)
i = 0
while i < count_of_apartments:
    areas_total_list.append(areas_unliv_cold_rooms_list[i] + areas_unliv_list[i])
    i += 1

# Словарь номеров квартир и площадей жилых и нежилых помещений вместе с неотапливаемыми
dictionary_total_area_apartment = dict(zip(apartments, areas_total_list))

# Назначение общей площади к помещениям в квартирах вместе с неотапливаемыми
for apartment in apartments:
    for room in rooms:
        apartment_number1 = room.LookupParameter("ADSK_Номер квартиры").AsString()
        total_area_all = dictionary_total_area_apartment.get(apartment_number1) / (0.3048 ** 2)
        room.LookupParameter("ADSK_Площадь квартиры общая").Set(total_area_all)

TransactionManager.Instance.TransactionTaskDone()

# Назначьте вывод переменной OUT.
OUT = get_unique_numbers(list2), areas_unliv_cold_rooms_list, areas_unliv_list, areas_total_list
# ----------------------------------------

описание_скрипта = StringInput("""1. По значениям параметров "Имя" и "ADSK_Номер квартиры" (их необходимо заполнить) расчитываются площади с коэффициентом, общ. жилая и общ.
2. Для подсчета кухни-гостиной необходимо: создать при помощи разделителя 2 помещения и назвать их "кухня-гостиная", поставить одинаковый номер. У нежилой комнаты поставить в параметр "Комментарии" => "нежилая". (в спецификации в сортировке не забыть отключить подсчет для одного экземпляра).""")  # graph input
