# Dynamo graph PGS_ADSK_Перемычки_01_разрезы.dyn "PGS_Перемычки_01_разрезы" (Dynamo 2.10.1.3976)
# packages: WombatDynamo 1.3.2, Genius Loci 2021.6.29, Clockwork for Dynamo 2.x 2.3.0

# note: Описание проекта и назначение программы Dynamo

# group: ИМПОРТ
# note: Используйте этот цвет группы для узлов, применяемых с целью импорта геометрии.

# group: ВЫВОД
# note: Используйте этот цвет группы для узлов, применяемых с целью создания элементов Revit.

# group: PYTHON
# note: Используйте этот цвет группы для узлов Python и других узлов, связанных со сценарием.

# group: ВХОДНЫЕ ДАННЫЕ
# note: Используйте этот цвет группы для входных данных программ (регуляторы, блоки кода и т.д.).

# group: ПРОЕКТ
# note: Используйте этот цвет группы для функций программы.

# group: Ввод названий семейств перемычек
n200_pgs_перемычка_металлическая = StringInput("200_PGS_Перемычка металлическая")  # "200_PGS_Перемычка металлическая"; graph input
n200_pgs_перемычка_сборная = StringInput("200_PGS_Перемычка сборнаяV2")  # "200_PGS_Перемычка сборная"; graph input

# group: Выбор по 1 экземпляру из каждого типа семейства перемычек
byName = Family.ByName(name=n200_pgs_перемычка_металлическая)
types = Family.Types(family=byName)
all_elements_of_family_type = ElementsOfFamilyType(Family_Type=types)
firstItem = List.FirstItem()  # unwired: list
map = List.Map(list=all_elements_of_family_type, function=firstItem)
byName_2 = Family.ByName(name=n200_pgs_перемычка_сборная)
types_2 = Family.Types(family=byName_2)
all_elements_of_family_type_2 = ElementsOfFamilyType(Family_Type=types_2)
firstItem_2 = List.FirstItem()  # unwired: list
map_2 = List.Map(list=all_elements_of_family_type_2, function=firstItem_2)
list_create = List.Create(item0=map, item1=map_2)
code_block = CodeBlock { 0; }
clean = List.Clean(list=list_create, preserveIndices=code_block)
flatten = List.Flatten(list=clean)

# group: Список существующих разрезов
code_block_2 = CodeBlock { "Section"; }
view_bytype = Custom[View ByType](viewType=code_block_2)  # package Genius Loci; Gets all views by type. For the View Template Type, the 3D View Templates will not be retrieved.
code_block_3 = CodeBlock { "Имя вида"; }
getParameterValueByName = Element.GetParameterValueByName(parameterName=code_block_3)  # unwired: element
map_3 = List.Map(list=view_bytype, function=getParameterValueByName)

# group: Фильтрация перемычек с созданными разрезами
code_block_4 = CodeBlock { "Мрк.МаркаКонструкции"; }
getParameterValueByName_2 = Element.GetParameterValueByName(element=flatten, parameterName=code_block_4)
contains = List.Contains(list=getParameterValueByName_2, item=map_3, lacing=CrossProduct)
anyTrue = List.AnyTrue(list=contains@L2, lacing=Longest)
filterByBoolMask = List.FilterByBoolMask(list=flatten, mask=anyTrue)
flatten_2 = List.Flatten(list=filterByBoolMask.out)

# group: Создание опорных плоскостей
geometry = Element.Geometry(element=flatten_2)
byLoft = Surface.ByLoft()  # unwired: crossSections
map_4 = List.Map(list=geometry, function=byLoft)

# group: Список размеров смещений для опорных плоскостей
code_block_5 = CodeBlock { "ADSK_Размер_Высота"; }
getParameterValueByName_3 = Element.GetParameterValueByName(parameterName=code_block_5)  # unwired: element
map_5 = List.Map(list=flatten_2, function=getParameterValueByName_3)
count = List.Count(list=map_4)

# group: Смещение опорных плоскостей
python_script = Python(IN[0]=map_4, IN[1]=map_5, IN[2]=count)  # IronPython2
# ---------- python_script.python (56 lines) ----------
import clr #This is .NET's Common Language Runtime. It's an execution environment
#that is able to execute code from several different languages.
import sys #sys is a fundamental Python library - here, we're using it to load in
#the standard IronPython libraries
sys.path.append('C:\Program Files (x86)\IronPython 2.7\Lib') #Imports the
#standard IronPython libraries, which cover everything from servers and
#encryption through to regular expressions.
import System #The System namespace at the root of .NET
from System import Array #.NET class for handling array information
from System.Collections.Generic import * #Lets you handle generics. Revit's API
#sometimes wants hard-typed 'generic' lists, called ILists. If you don't need
#these you can delete this line.
clr.AddReference('ProtoGeometry')  #A Dynamo library for its proxy geometry
#classes. You'll only need this if you're interacting with geometry.
from Autodesk.DesignScript.Geometry import * #Loads everything in Dynamo's
#geometry library
clr.AddReference("RevitNodes") #Dynamo's nodes for Revit
import Revit #Loads in the Revit namespace in RevitNodes
clr.ImportExtensions(Revit.Elements) #More loading of Dynamo's Revit libraries
clr.ImportExtensions(Revit.GeometryConversion) #More loading of Dynamo's
#Revit libraries. You'll only need this if you're interacting with geometry.
clr.AddReference("RevitServices") #Dynamo's classes for handling Revit documents
import RevitServices 
from RevitServices.Persistence import DocumentManager #An internal Dynamo class
#that keeps track of the document that Dynamo is currently attached to
from RevitServices.Transactions import TransactionManager #A Dynamo class for
#opening and closing transactions to change the Revit document's database

clr.AddReference("RevitAPI") #Adding reference to Revit's API DLLs
clr.AddReference("RevitAPIUI") #Adding reference to Revit's API DLLs

import Autodesk #Loads the Autodesk namespace
from Autodesk.Revit.DB import * #Loading Revit's API classes
from Autodesk.Revit.UI import * #Loading Revit's API UI classes  

doc = DocumentManager.Instance.CurrentDBDocument #Finally, setting up handles to the active Revit document
uiapp = DocumentManager.Instance.CurrentUIApplication #Setting a handle to the active Revit UI document
app = uiapp.Application  #Setting a handle to the currently-open instance of the Revit application
uidoc = uiapp.ActiveUIDocument #Setting a handle to the currently-open instance of the Revit UI application

#######OK NOW YOU CAN CODE########

input_list_of_surfaces = IN[0]
input_list_of_high = IN[1]
count_of_elements = IN[2]

output_list_of_surfaces = []

i = 0
while i < count_of_elements:
	vector = Vector.ByCoordinates(0, 0, input_list_of_high[i])
	surface = Geometry.Translate(input_list_of_surfaces[i], vector)
	output_list_of_surfaces.append(surface)
	i = i + 1
	
OUT = output_list_of_surfaces
# ----------------------------------------

# group: Получение вектора продольной оси проема
code_block_6 = CodeBlock { 0.5; 1; }
pointAtParameter = Surface.PointAtParameter(surface=python_script, u=code_block_6.out0, v=code_block_6.out1)
code_block_7 = CodeBlock { 0.5; 0; }
pointAtParameter_2 = Surface.PointAtParameter(surface=python_script, u=code_block_7.out0, v=code_block_7.out1)
byTwoPoints = Vector.ByTwoPoints(start=pointAtParameter, end=pointAtParameter_2)

# group: Системы координат в центре нижней грани перемычки
byStartPointEndPoint = Line.ByStartPointEndPoint(startPoint=pointAtParameter, endPoint=pointAtParameter_2)
code_block_8 = CodeBlock { 0.5; }
pointAtParameter_3 = Curve.PointAtParameter(curve=byStartPointEndPoint, param=code_block_8)
byOrigin = CoordinateSystem.ByOrigin(origin=pointAtParameter_3)

# group: Поворот систем координат вокруг вертикальной оси (OY теперь будет вдоль длины перемычки)
origin = CoordinateSystem.Origin(coordinateSystem=byOrigin)
code_block_9 = CodeBlock { 1; }
translate = Geometry.Translate(geometry=origin, zTranslation=code_block_9)
byTwoPoints_2 = Vector.ByTwoPoints(start=origin, end=translate)
YAxis = CoordinateSystem.YAxis(coordinateSystem=byOrigin)
ZAxis = CoordinateSystem.ZAxis(coordinateSystem=byOrigin)
angleAboutAxis = Vector.AngleAboutAxis(vector=byTwoPoints, otherVector=YAxis, rotationAxis=ZAxis)
code_block_10 = CodeBlock(a=angleAboutAxis) { -a; }
rotate = CoordinateSystem.Rotate(coordinateSystem=byOrigin, origin=origin, axis=byTwoPoints_2, degrees=code_block_10)

# group: Поворот сестемы координат вокруг горизонтальной оси (Центр СК в центре нижней грани перемычки, OZ вдоль перемычки, OX вправо по нормали от оси перемычки, OY вниз)
origin_2 = CoordinateSystem.Origin(coordinateSystem=rotate)
XAxis = CoordinateSystem.XAxis(coordinateSystem=rotate)
code_block_11 = CodeBlock { 1; }
translate_2 = Geometry.Translate(geometry=origin_2, direction=XAxis, distance=code_block_11)
ось_x_в_пск_для_каждой_перемычки = Vector.ByTwoPoints(start=origin_2, end=translate_2)
code_block_12 = CodeBlock { 90; }
rotate_2 = CoordinateSystem.Rotate(coordinateSystem=rotate, origin=origin_2, axis=ось_x_в_пск_для_каждой_перемычки, degrees=code_block_12)

# group: Список толщин для ширины видового экрана разреза
code_block_13 = CodeBlock { 1; 0; }
pointAtParameter_4 = Surface.PointAtParameter(surface=python_script, u=code_block_13.out1, v=code_block_13.out0)
pointAtParameter_5 = Surface.PointAtParameter(surface=python_script, u=code_block_13.out0, v=code_block_13.out0)
список_толщин_стен = Geometry.DistanceTo(geometry=pointAtParameter_4, other=pointAtParameter_5)
полуширина_видового_экрана = CodeBlock(a=список_толщин_стен) { a/2 + 50; }

# group: Смещение дальнего предела секущего диапазона
смещение_дальнего_предела = DoubleSlider(300, range=0..1000 step 50)  # "Смещение дальнего предела секущего диапазона"; graph input

# group: Задание габаритов кубоида для разрезов
code_block_14 = CodeBlock(b=полуширина_видового_экрана) { -b; }
code_block_15 = CodeBlock { -300; 300; -50; 450; }
относительнаая_координата_нижней = Point.ByCoordinates(x=code_block_14, y=code_block_15.out2)  # "Относительнаая координата нижней ближней левой точки ВЭ"
относительная_координата_верхней = Point.ByCoordinates(x=полуширина_видового_экрана, y=code_block_15.out3, z=смещение_дальнего_предела)  # "Относительная координата верхней дальней правой точки ВЭ"

# group: Создание разрезов
byCoordinateSystemMinPointMaxPoint = SectionView.ByCoordinateSystemMinPointMaxPoint(cs=rotate_2, minPoint=относительнаая_координата_нижней, maxPoint=относительная_координата_верхней)

# group: Назначение "Имя вида" для разрезов по Мрк.МаркаКонструкции перемычки
code_block_16 = CodeBlock { "Имя вида"; }
count_2 = List.Count(list=byCoordinateSystemMinPointMaxPoint)
cycle = List.Cycle(list=code_block_16, amount=count_2)
code_block_17 = CodeBlock { "Мрк.МаркаКонструкции"; }
getParameterValueByName_4 = Element.GetParameterValueByName(element=flatten_2, parameterName=code_block_17)
setParameterValuesByNames = WombatDynamo.Element.SetParameterValuesByNames(element=byCoordinateSystemMinPointMaxPoint, parameterNames=cycle, values=getParameterValueByName_4, lacing=Shortest)

# group: Назначение шаблона вида
code_block_18 = CodeBlock { "Шаблон вида"; }
element_types = ElementTypes("View")
all_elements_of_type = ElementsOfType(element_type=element_types)
string_from_object = FromObject(object=all_elements_of_type)
code_block_19 = CodeBlock { "PGS_Перемычки"; }
code_block_20 = CodeBlock { 1; }
contains_2 = String.Contains(str=string_from_object, searchFor=code_block_19, ignoreCase=code_block_20)
filterByBoolMask_2 = List.FilterByBoolMask(list=all_elements_of_type, mask=contains_2)
setParameterByName = Element.SetParameterByName(element=byCoordinateSystemMinPointMaxPoint, parameterName=code_block_18, value=filterByBoolMask_2.in, lacing=Longest)

# group: Создание линии дли "Линии обрыва"
origin_3 = View.Origin()  # unwired: view
map_6 = List.Map(list=byCoordinateSystemMinPointMaxPoint, function=origin_3)
translate_3 = Geometry.Translate(geometry=map_6, zTranslation=code_block_15.out3)
rightDirection = View.RightDirection(view=byCoordinateSystemMinPointMaxPoint)
code_block_21 = CodeBlock { 50; }
translate_4 = Geometry.Translate(geometry=translate_3, direction=rightDirection, distance=code_block_21)
code_block_22 = CodeBlock(a=полуширина_видового_экрана) { 2*a-50; }
translate_5 = Geometry.Translate(geometry=translate_3, direction=rightDirection, distance=code_block_22)
byStartPointEndPoint_2 = Line.ByStartPointEndPoint(startPoint=translate_4, endPoint=translate_5)

# group: Создание линии обрыва
family_types = FamilyTypes("ADSK_Обрыв_Линия:По умолчанию")
byCurve = Custom[DetailComponent.ByCurve](curve=byStartPointEndPoint_2, familyType=family_types, view=byCoordinateSystemMinPointMaxPoint, lacing=Longest)  # package Clockwork for Dynamo 2.x; Places a line-based detail component in a given view
