# Dynamo graph PGS_ADSK_Перемычки_02_изображения.dyn "PGS_Перемычки_02_изображения" (Dynamo 2.10.1.3976)
# packages: Clockwork for Dynamo 2.x 2.3.0, spring nodes 110.0.2

# note: Описание проекта и назначение программы Dynamo

# group: ИМПОРТ
# note: Используйте этот цвет группы для узлов, применяемых с целью импорта геометрии.

# group: ВЫВОД
# note: Используйте этот цвет группы для узлов, применяемых с целью создания элементов Revit.

# group: PYTHON
# note: Используйте этот цвет группы для узлов Python и других узлов, связанных со сценарием.

# group: ВХОДНЫЕ ДАННЫЕ
# note: Используйте этот цвет группы для входных данных программ (регуляторы, блоки кода и т.д.).

# group: ПРОЕКТ
# note: Используйте этот цвет группы для функций программы.

# group: Список экземпляров перемычек
string = StringInput("200_PGS_Перемычка металлическая")
byName = Family.ByName(name=string)
types = Family.Types(family=byName)
all_elements_of_family_type = ElementsOfFamilyType(Family_Type=types)
string_2 = StringInput("200_PGS_Перемычка сборнаяV2")
byName_2 = Family.ByName(name=string_2)
types_2 = Family.Types(family=byName_2)
all_elements_of_family_type_2 = ElementsOfFamilyType(Family_Type=types_2)
list_create = List.Create(item0=all_elements_of_family_type, item1=all_elements_of_family_type_2)
flatten = List.Flatten(list=list_create)

# group: Список изображений в проекте
categories = Categories("OST_RasterImages")
all_family_types_of_category = Custom[All Family Types Of Category](category=categories)  # package Clockwork for Dynamo 2.x; Gets all family types/symbols of a given category in the model.
code_block = CodeBlock { "Имя типа"; }
nullGetParameter = Custom[Springs.NullGetParameter](element=all_family_types_of_category, parameter=code_block)  # package spring nodes; Similar to the built in node.Capable of handling null values, part of the SmartCopyMonitor workflow.

# group: Фильтрация изображений перемычек
code_block_2 = CodeBlock { "ПР-"; }
contains = String.Contains(str=nullGetParameter, searchFor=code_block_2)
filterByBoolMask = List.FilterByBoolMask(list=all_family_types_of_category, mask=contains)

# group: Список ключей для библиотеки изображений по Мрк.МаркаКонструкции перемычек
code_block_3 = CodeBlock { "Мрк.МаркаКонструкции"; }
getParameterValueByName = Element.GetParameterValueByName(element=flatten, parameterName=code_block_3)

# group: Создание библиотеки изображений перемычек
code_block_4 = CodeBlock { "Имя типа"; }
getParameterValueByName_2 = Element.GetParameterValueByName(element=filterByBoolMask.in, parameterName=code_block_4)
byKeysValues = Custom[Springs.Dictionary.ByKeysValues](keys=getParameterValueByName_2, values=filterByBoolMask.in, searchKeys=getParameterValueByName)  # package spring nodes; Dictionaries are an incredibly powerful tool for making associative sets between two equal length lists. The first list must be of unique strings (or numbers) and will be the key and the second list will be the matching values (it can be made up of geometry, elements, even other lists) The search keys list will provide the corresponding value to the input key.

# group: Назначение изображений экземплярам перемычек на основе Мрк.МаркаКонструкции
code_block_5 = CodeBlock { "Изображение"; }
setParameterByName = Element.SetParameterByName(element=flatten, parameterName=code_block_5, value=byKeysValues, lacing=Longest)
