# Dynamo graph PGS_04_1_ЧастиИзСтен.dyn (Dynamo 2.10.1.3976)

# note: Описание проекта и назначение программы Dynamo

# group: ИМПОРТ
# note: Используйте этот цвет группы для узлов, применяемых с целью импорта геометрии.

# group: ВЫВОД
# note: Используйте этот цвет группы для узлов, применяемых с целью создания элементов Revit.

# group: PYTHON
# note: Используйте этот цвет группы для узлов Python и других узлов, связанных со сценарием.

# group: ВХОДНЫЕ ДАННЫЕ
# note: Используйте этот цвет группы для входных данных программ (регуляторы, блоки кода и т.д.).

# group: ПРОЕКТ
# note: Используйте этот цвет группы для функций программы.

# group: Совместная работа
вы_в_совместной_работе = BoolSelector(true)  # graph input
название_рабочего_набора = StringInput("Тест")  # graph input
AR = StringInput("AR_")  # graph input

# group: Основной код
python_script = Python(IN[0]=вы_в_совместной_работе, IN[1]=название_рабочего_набора, IN[2]=AR)  # IronPython2
# ---------- python_script.python (80 lines) ----------
#Подключение библиотек
import clr
clr.AddReference('ProtoGeometry')
from Autodesk.DesignScript.Geometry import *
clr.AddReference('RevitAPI')
from Autodesk.Revit.DB import *
clr.AddReference("RevitServices")
import RevitServices
from RevitServices.Persistence import DocumentManager
from RevitServices.Transactions import TransactionManager
from System.Collections.Generic import List
doc = DocumentManager.Instance.CurrentDBDocument
#--------------Взятие элементов------------------------
walls = FilteredElementCollector(doc).OfCategory(BuiltInCategory.OST_Walls).WhereElementIsNotElementType().ToElements()
#Ссылка на BuiltInCategories: http://www.revitapidocs.com/2018.1/ba1c5b30-242f-5fdc-8ea9-ec3b61e6e722.htm

# Создание списка стен
wallsList = []
for wall in walls:
	wallsList.append(wall)

# Создание списка стен, принадлежащих рабочему набору IN[1], если верно выражение IN[0]
worksetWalls = []
if (IN[0] == True):
	i = 0
	while i < len(wallsList):
		if (wallsList[i].get_Parameter(BuiltInParameter.ELEM_PARTITION_PARAM).AsValueString() != IN[1]):
			wallsList[i] = None
		i += 1
	wallsList = list(filter(None, wallsList))

# Удаление из списка однослойных стен
i = 0
while i < len(wallsList):
	if (len(wallsList[i].WallType.GetCompoundStructure().GetLayers()) < 2):
		wallsList[i] = None
	i += 1
wallsList = list(filter(None, wallsList))

# Удаление из списка стен, в названии типа которых нет AR_
i = 0
while i < len(wallsList):
	if not(IN[2] in wallsList[i].get_Parameter(BuiltInParameter.ELEM_TYPE_PARAM).AsValueString()):
		wallsList[i] = None
	i += 1
wallsList = list(filter(None, wallsList))

# Удаление из списка стен, из которых нельзя создать части
i = 0
while i < len(wallsList):
	if not(PartUtils.IsValidForCreateParts(doc, LinkElementId(wallsList[i].Id))):
		wallsList[i] = None
	i += 1
wallsList = list(filter(None, wallsList))

#Список Id стен
wallsIds = []
for wall in wallsList:
	wallsIds.append(wall.Id)
IDS = List[ElementId](wallsIds)

#Создание частей
TransactionManager.Instance.ForceCloseTransaction()
trans = Transaction(doc, "ЧастиИзСтен")
trans.Start()
PartUtils.CreateParts(doc, IDS)

# Удаление из списка стен, из которых нельзя создать части
i = 0
while i < len(wallsList):
	if not(PartUtils.IsValidForCreateParts(doc, LinkElementId(wallsList[i].Id))):
		wallsList[i] = None
	i += 1
wallsList = list(filter(None, wallsList))
i = 0

trans.Commit()
TransactionManager.Instance.ForceCloseTransaction()
#Назначьте вывод переменной OUT.
OUT = wallsList, IDS
# ----------------------------------------
