# Dynamo graph PGS_04_2_ПодсчетЧастиИСтены.dyn (Dynamo 2.10.1.3976)

# note: Описание проекта и назначение программы Dynamo

# group: ИМПОРТ
# note: Используйте этот цвет группы для узлов, применяемых с целью импорта геометрии.

# group: ВЫВОД
# note: Используйте этот цвет группы для узлов, применяемых с целью создания элементов Revit.

# group: PYTHON
# note: Используйте этот цвет группы для узлов Python и других узлов, связанных со сценарием.

# group: ВХОДНЫЕ ДАННЫЕ
# note: Используйте этот цвет группы для входных данных программ (регуляторы, блоки кода и т.д.).

# group: ПРОЕКТ
# note: Используйте этот цвет группы для функций программы.

# group: Совместная работа
вы_в_совместной_работе = BoolSelector(true)  # graph input
параметр_рабочий_набор = StringInput("Рабочий набор")
название_рабочего_набора = StringInput("Тест")  # graph input

# group: Категория для назначения параметров
categories = Categories("OST_Walls")
all_elements_of_category = ElementsOfCategory(Category=categories)

# group: Выбор стен по рабочему набору
python_script = Python(IN[0]=all_elements_of_category, IN[1]=параметр_рабочий_набор, IN[2]=название_рабочего_набора)  # IronPython2
# ---------- python_script.python (36 lines) ----------
import clr
clr.AddReference('ProtoGeometry')
from Autodesk.DesignScript.Geometry import *
# Import ToDSType(bool) extension method
clr.AddReference("RevitNodes")
import Revit
clr.ImportExtensions(Revit.Elements)
# Import geometry conversion extension methods
clr.ImportExtensions(Revit.GeometryConversion)
# Import DocumentManager and TransactionManager
clr.AddReference("RevitServices")
import RevitServices
from RevitServices.Persistence import DocumentManager
from RevitServices.Transactions import TransactionManager
from System.Collections.Generic import *
# Import RevitAPI
clr.AddReference("RevitAPI")
import Autodesk
from Autodesk.Revit.DB import *

doc = DocumentManager.Instance.CurrentDBDocument

#ОСНОВНАЯ ЧАСТЬ КОДА
elements = []
out = []

for i in IN[0]:
	elements.append(UnwrapElement(i))

for element in elements:
	if (element.LookupParameter(IN[1]).AsValueString() == IN[2]):
		out.append(element)


#This was originally IDS but just gave me a string list of the parents IDs.
OUT = out
# ----------------------------------------

# group: If else
python_script_2 = Python(IN[0]=вы_в_совместной_работе, IN[1]=python_script, IN[2]=all_elements_of_category)  # IronPython2
# ---------- python_script_2.python (5 lines) ----------
if (IN[0]):
	out = IN[1]
else:
	out = IN[2]
OUT = out
# ----------------------------------------

# group: Входные данные для заполнения параметров
параметр_для_записи = StringInput("АР_ВключатьВРасчет")  # graph input
для_элементов_если_части_созданы = DoubleInput(0)  # "Для элементов. Если части созданы (false)"; graph input
для_элементов_если_части_не = DoubleInput(1)  # "Для элементов. Если части не созданы (true)"; graph input
для_частей_true = DoubleInput(1)  # graph input

# group: Назначение параметра
python_script_3 = Python(IN[0]=python_script_2, IN[1]=параметр_для_записи, IN[2]=для_элементов_если_части_созданы, IN[3]=для_элементов_если_части_не)  # IronPython2
# ---------- python_script_3.python (57 lines) ----------
import clr
clr.AddReference('ProtoGeometry')
from Autodesk.DesignScript.Geometry import *
# Import ToDSType(bool) extension method
clr.AddReference("RevitNodes")
import Revit
clr.ImportExtensions(Revit.Elements)
# Import geometry conversion extension methods
clr.ImportExtensions(Revit.GeometryConversion)
# Import DocumentManager and TransactionManager
clr.AddReference("RevitServices")
import RevitServices
from RevitServices.Persistence import DocumentManager
from RevitServices.Transactions import TransactionManager
from System.Collections.Generic import *
# Import RevitAPI
clr.AddReference("RevitAPI")
import Autodesk
from Autodesk.Revit.DB import *

doc = DocumentManager.Instance.CurrentDBDocument

#ОСНОВНАЯ ЧАСТЬ КОДА
elts = []
Ids = []
boolList = []

for i in IN[0]:
	elts.append(UnwrapElement(i))

for element in elts:
	Ids.append(LinkElementId(element.Id))
	
IDS = List[LinkElementId](Ids)

# Start Transaction tt
TransactionManager.Instance.EnsureInTransaction(doc)

for id in IDS:
	boolList.append(PartUtils.IsValidForCreateParts(doc, id))
out = []
i = 0
for wall in elts:
	if (boolList[i]==True):
		wall.LookupParameter(IN[1]).Set(IN[3])
		
	else:
		wall.LookupParameter(IN[1]).Set(IN[2])
	i += 1
	
	
# End Transaction - by original script.
TransactionManager.Instance.TransactionTaskDone()


#This was originally IDS but just gave me a string list of the parents IDs.
OUT = boolList
# ----------------------------------------

# group: Описание скрипта
описание_скрипта = StringInput("""Скрипт анализирует все стены в проекте и в зависимости от возможности создания "частей" из них записывает в параметр для записи входные значения. Совместная работа учитывается переключателем.

Параметр для записи должен быть на уровне экземпляра, текстового типа данных, не выровненный по группе. По умолчанию предполагается использование специально созданного параметра проекта.""")  # graph input

# group: Категория для назначения параметров
categories_2 = Categories("OST_Walls")
all_elements_of_category_2 = ElementsOfCategory(Category=categories_2)

# group: Категория для назначения параметров
categories_3 = Categories("OST_Parts")
all_elements_of_category_3 = ElementsOfCategory(Category=categories_3)

# group: Выбор частей по рабочему набору
python_script_4 = Python(IN[0]=all_elements_of_category_3, IN[1]=параметр_рабочий_набор, IN[2]=название_рабочего_набора)  # IronPython2
# ---------- python_script_4.python (35 lines) ----------
import clr
clr.AddReference('ProtoGeometry')
from Autodesk.DesignScript.Geometry import *
# Import ToDSType(bool) extension method
clr.AddReference("RevitNodes")
import Revit
clr.ImportExtensions(Revit.Elements)
# Import geometry conversion extension methods
clr.ImportExtensions(Revit.GeometryConversion)
# Import DocumentManager and TransactionManager
clr.AddReference("RevitServices")
import RevitServices
from RevitServices.Persistence import DocumentManager
from RevitServices.Transactions import TransactionManager
from System.Collections.Generic import *
# Import RevitAPI
clr.AddReference("RevitAPI")
import Autodesk
from Autodesk.Revit.DB import *

doc = DocumentManager.Instance.CurrentDBDocument

#ОСНОВНАЯ ЧАСТЬ КОДА
elements = []
out = []

for i in IN[0]:
	elements.append(UnwrapElement(i))

for element in elements:
	if (element.LookupParameter(IN[1]).AsValueString() == IN[2]):
		out.append(element)
	
#This was originally IDS but just gave me a string list of the parents IDs.
OUT = out
# ----------------------------------------

# group: If else
python_script_5 = Python(IN[0]=вы_в_совместной_работе, IN[1]=python_script_4, IN[2]=all_elements_of_category_3)  # IronPython2; same code as python_script_2

# group: Назначение параметра
python_script_6 = Python(IN[0]=python_script_5, IN[1]=параметр_для_записи, IN[2]=для_частей_true)  # IronPython2
# ---------- python_script_6.python (43 lines) ----------
import clr
clr.AddReference('ProtoGeometry')
from Autodesk.DesignScript.Geometry import *
# Import ToDSType(bool) extension method
clr.AddReference("RevitNodes")
import Revit
clr.ImportExtensions(Revit.Elements)
# Import geometry conversion extension methods
clr.ImportExtensions(Revit.GeometryConversion)
# Import DocumentManager and TransactionManager
clr.AddReference("RevitServices")
import RevitServices
from RevitServices.Persistence import DocumentManager
from RevitServices.Transactions import TransactionManager
from System.Collections.Generic import *
# Import RevitAPI
clr.AddReference("RevitAPI")
import Autodesk
from Autodesk.Revit.DB import *

doc = DocumentManager.Instance.CurrentDBDocument

#ОСНОВНАЯ ЧАСТЬ КОДА
elements = []

for i in IN[0]:
	elements.append(UnwrapElement(i))



# Start Transaction tt
TransactionManager.Instance.EnsureInTransaction(doc)


for part in elements:
	part.LookupParameter(IN[1]).Set(IN[2])
		
# End Transaction - by original script.
TransactionManager.Instance.TransactionTaskDone()


#This was originally IDS but just gave me a string list of the parents IDs.
OUT = elements
# ----------------------------------------
