# Dynamo graph PGS_04_3_ТолщСтеныЧасти.dyn (Dynamo 2.10.1.3976)

# note: Описание проекта и назначение программы Dynamo

# group: ИМПОРТ
# note: Используйте этот цвет группы для узлов, применяемых с целью импорта геометрии.

# group: ВЫВОД
# note: Используйте этот цвет группы для узлов, применяемых с целью создания элементов Revit.

# group: PYTHON
# note: Используйте этот цвет группы для узлов Python и других узлов, связанных со сценарием.

# group: ВХОДНЫЕ ДАННЫЕ
# note: Используйте этот цвет группы для входных данных программ (регуляторы, блоки кода и т.д.).

# group: ПРОЕКТ
# note: Используйте этот цвет группы для функций программы.

# group: Совместная работа
вы_в_совместной_работе = BoolSelector(true)  # graph input
название_рабочего_набора = StringInput("Тест")  # graph input
название_типа_стены_содержит = StringInput("AR_")  # graph input
параметр_для_записи = StringInput("АР_Толщина стен")  # graph input

# group: Основной код
python_script = Python(IN[0]=вы_в_совместной_работе, IN[1]=название_рабочего_набора, IN[2]=название_типа_стены_содержит, IN[3]=параметр_для_записи)  # IronPython2
# ---------- python_script.python (94 lines) ----------
#Подключение библиотек
import clr
clr.AddReference('ProtoGeometry')
from Autodesk.DesignScript.Geometry import *
clr.AddReference('RevitAPI')
from Autodesk.Revit.DB import *
clr.AddReference("RevitServices")
import RevitServices
from RevitServices.Persistence import DocumentManager
from RevitServices.Transactions import TransactionManager
from System.Collections.Generic import List
doc = DocumentManager.Instance.CurrentDBDocument
#--------------Взятие элементов------------------------
walls = FilteredElementCollector(doc).OfCategory(BuiltInCategory.OST_Walls).WhereElementIsNotElementType().ToElements()
parts = FilteredElementCollector(doc).OfCategory(BuiltInCategory.OST_Parts).WhereElementIsNotElementType().ToElements()
#Ссылка на BuiltInCategories: http://www.revitapidocs.com/2018.1/ba1c5b30-242f-5fdc-8ea9-ec3b61e6e722.htm

# Создание списка стен
wallsList = []
for wall in walls:
	wallsList.append(wall)
	
# Создание списка частей
partsList = []
for part in parts:
	partsList.append(part)

# Удаление из списка стен, не принадлежащих рабочему набору IN[1], если верно выражение IN[0]
if (IN[0] == True):
	i = 0
	while i < len(wallsList):
		if (wallsList[i].get_Parameter(BuiltInParameter.ELEM_PARTITION_PARAM).AsValueString() != IN[1]):
			wallsList[i] = None
		i += 1
	wallsList = list(filter(None, wallsList))

# Удаление из списка частей, не принадлежащих рабочему набору IN[1], если верно выражение IN[0]
if (IN[0] == True):
	i = 0
	while i < len(partsList):
		if (partsList[i].get_Parameter(BuiltInParameter.ELEM_PARTITION_PARAM).AsValueString() != IN[1]):
			partsList[i] = None
		i += 1
	partsList = list(filter(None, partsList))

# Удаление из списка многослойных стен
i = 0
while i < len(wallsList):
	if (len(wallsList[i].WallType.GetCompoundStructure().GetLayers()) > 1):
		wallsList[i] = None
	i += 1
wallsList = list(filter(None, wallsList))

# Удаление из списка стен, в названии типа которых нет AR_
i = 0
while i < len(wallsList):
	if not(IN[2] in wallsList[i].get_Parameter(BuiltInParameter.ELEM_TYPE_PARAM).AsValueString()):
		wallsList[i] = None
	i += 1
wallsList = list(filter(None, wallsList))

# Удаление из списка стен, из которых нельзя создать части
i = 0
while i < len(wallsList):
	if not(PartUtils.IsValidForCreateParts(doc, LinkElementId(wallsList[i].Id))):
		wallsList[i] = None
	i += 1
wallsList = list(filter(None, wallsList))

#Список Id стен
wallsIds = []
for wall in wallsList:
	wallsIds.append(wall.Id)
IDS = List[ElementId](wallsIds)

#Назначение параметров
TransactionManager.Instance.ForceCloseTransaction()
trans = Transaction(doc, "Толщина стен и частей")
trans.Start()

#Назначение параметра частям
parameter = IN[3]
for part in partsList:
	value = str(int(round((part.get_Parameter(BuiltInParameter.DPART_LAYER_WIDTH).AsDouble())*304.8)))
	part.LookupParameter(parameter).Set(value)

#Назначение параметра 
for wall in wallsList:
	value = str(int(round(wall.WallType.Width*304.8)))
	wall.LookupParameter(parameter).Set(value)

trans.Commit()
#Назначьте вывод переменной OUT.
OUT = wallsList, partsList
# ----------------------------------------
