# Dynamo graph PGS_04_4_Наименование_внутренних_внешних_стен.dyn "PGS_Наименование внутренних_внешних стен" (Dynamo 2.10.1.3976)

# note: Описание проекта и назначение программы Dynamo

# group: ИМПОРТ
# note: Используйте этот цвет группы для узлов, применяемых с целью импорта геометрии.

# group: ВЫВОД
# note: Используйте этот цвет группы для узлов, применяемых с целью создания элементов Revit.

# group: PYTHON
# note: Используйте этот цвет группы для узлов Python и других узлов, связанных со сценарием.

# group: ВХОДНЫЕ ДАННЫЕ
# note: Используйте этот цвет группы для входных данных программ (регуляторы, блоки кода и т.д.).

# group: ПРОЕКТ
# note: Используйте этот цвет группы для функций программы.

categories = Categories("OST_Walls")
all_elements_of_category = ElementsOfCategory(Category=categories)

# group: Входные данные
параметр_имя_типа = StringInput("Тип")
что_содержит_в_имя_типа = StringInput("N_")  # graph input
параметр_куда_записывать_функцию = StringInput("АР_ФункцСтены")  # "Параметр, куда записывать функцию стены"
что_записывать_в_параметр_ар = StringInput("Наружные стены")  # "Что записывать в параметр АР_ФункцСтены"; graph input
параметр_исходный_тип_у_частей = StringInput("Исходный тип")
что_записать_если_отделочный = StringInput("Отделка")  # "Что записать, если отделочный слой в наружной многослойной стене"; graph input

categories_2 = Categories("OST_Parts")
all_elements_of_category_2 = ElementsOfCategory(Category=categories_2)

# group: Расчет
назначение_параметров_по_входным = Python(IN[0]=all_elements_of_category, IN[1]=параметр_имя_типа, IN[2]=что_содержит_в_имя_типа, IN[3]=параметр_куда_записывать_функцию, IN[4]=что_записывать_в_параметр_ар, IN[5]=all_elements_of_category_2, IN[6]=параметр_исходный_тип_у_частей, IN[7]=что_записать_если_отделочный)  # "Назначение параметров по входным данным"; IronPython2
# ---------- назначение_параметров_по_входным.python (52 lines) ----------
import clr
clr.AddReference('ProtoGeometry')
from Autodesk.DesignScript.Geometry import *
# Import ToDSType(bool) extension method
clr.AddReference("RevitNodes")
import Revit
clr.ImportExtensions(Revit.Elements)
# Import geometry conversion extension methods
clr.ImportExtensions(Revit.GeometryConversion)
# Import DocumentManager and TransactionManager
clr.AddReference("RevitServices")
import RevitServices
from RevitServices.Persistence import DocumentManager
from RevitServices.Transactions import TransactionManager
from System.Collections.Generic import *
# Import RevitAPI
clr.AddReference("RevitAPI")
import Autodesk
from Autodesk.Revit.DB import *

doc = DocumentManager.Instance.CurrentDBDocument

#Инициализация списка входных элементов и списка вывода
walls = []
parts = []
out = []

#Заполнение списка из входных элементов для анализа
for w in IN[0]:
	walls.append(UnwrapElement(w))

for p in IN[5]:
	parts.append(UnwrapElement(p))
	
TransactionManager.Instance.EnsureInTransaction(doc)

#Проверка, совпадает ли рабочий набор элемента IN[1]
#с входным значением IN[2]
for wall in walls:
	if (IN[2] in wall.LookupParameter(IN[1]).AsValueString()):
		wall.LookupParameter(IN[3]).Set(IN[4])
	
for part in parts:
	if (IN[2] in part.LookupParameter(IN[6]).AsValueString()):
		part.LookupParameter(IN[3]).Set(IN[4])

for part in parts:
	if (("N_" in part.LookupParameter(IN[6]).AsValueString()) and (("1" in part.LookupParameter("Индекс слоя").AsValueString()) or ("2" in part.LookupParameter("Индекс слоя").AsValueString()))):
		part.LookupParameter(IN[3]).Set(IN[7])
TransactionManager.Instance.TransactionTaskDone()	
#Вывод элементов с входным рабочим набором IN[2]
OUT = out
# ----------------------------------------
