# Dynamo graph PGS_Площадь проемов_АР+КР.dyn (Dynamo 2.10.1.3976)

# group: Наименования параметров
площадь_проемов = StringInput("АР_ПлощПроемов")  # graph input
стадия = StringInput("Новая конструкция")  # graph input

retry = BoolSelector(false)  # graph input
параметр_ширины_параметр_высоты = CodeBlock { ["Рзм.Ширина","Рзм.Высота","Э"]; }  # "Параметр ширины, Параметр высоты, Э/Т (Экземпляр/Типоразмер)"
параметр_ширины_параметр_высоты_2 = CodeBlock { ["Рзм.Ширина","Рзм.Высота","Т"]; }  # "Параметр ширины, Параметр высоты, Э/Т (Экземпляр/Типоразмер)"

# group: Параметры ширины и высоты окон и дверей
параметр_ширины_параметр_высоты_3 = CodeBlock { ["Примерная ширина","Примерная высота","Э"]; }  # "Параметр ширины, Параметр высоты, Э/Т (Экземпляр/Типоразмер)"
параметр_ширины_параметр_высоты_4 = CodeBlock { ["Ширина","Высота","Э"]; }  # "Параметр ширины, Параметр высоты, Э/Т (Экземпляр/Типоразмер)"
параметр_ширины_параметр_высоты_5 = CodeBlock { ["Примерная ширина","Примерная высота","Т"]; }  # "Параметр ширины, Параметр высоты, Э/Т (Экземпляр/Типоразмер)"
параметр_ширины_параметр_высоты_6 = CodeBlock { ["Ширина","Высота","Т"]; }  # "Параметр ширины, Параметр высоты, Э/Т (Экземпляр/Типоразмер)"
create = List.Create(item0=параметр_ширины_параметр_высоты_3, item1=параметр_ширины_параметр_высоты_4, item2=параметр_ширины_параметр_высоты, item3=параметр_ширины_параметр_высоты_5, item4=параметр_ширины_параметр_высоты_6, item5=параметр_ширины_параметр_высоты_2)

# group: Расчет
python_script = Python(IN[0]=площадь_проемов, IN[1]=retry, IN[2]=create, IN[3]=стадия)  # IronPython2
# ---------- python_script.python (144 lines) ----------
import clr
clr.AddReference('ProtoGeometry')
from Autodesk.DesignScript.Geometry import *
clr.AddReference('RevitAPI')
from Autodesk.Revit.DB import *
clr.AddReference("RevitServices")
import RevitServices
from RevitServices.Persistence import DocumentManager
from RevitServices.Transactions import TransactionManager
doc = DocumentManager.Instance.CurrentDBDocument
opt = SpatialElementBoundaryOptions()



pS = IN[0]
pars=IN[2]

TransactionManager.Instance.EnsureInTransaction(doc)
#rooms = get_selected_elements()
def get_selected_elements():
	ids = uidoc.Selection.GetElementIds()
	if isinstance(ids, list) == True:
		ids=[ids]
	els = []
	for id in ids:
		el = doc.GetElement(id)
		els.append(el)
	return els
	
########################           СТАДИЯ          ################################
input = IN[3]
###################################################################################

########################     КОМНАТЫ ВСЕ В ПРОЕКТЕ ################################
rooms_all = FilteredElementCollector(doc).OfCategory(BuiltInCategory.OST_Rooms).WhereElementIsNotElementType().ToElements()
########################     КОМНАТЫ ПО СТАДИИ     ################################
rooms = []

for room in rooms_all:
	room_phase = room.LookupParameter("Стадия").AsValueString()
	if room_phase == input:
		rooms.append(room)
####################################################################################

########################     ОКНА ВСЕ В ПРОЕКТЕ ################################
windows_all = FilteredElementCollector(doc).OfCategory(BuiltInCategory.OST_Windows).WhereElementIsNotElementType().ToElements()
########################     ОКНА ПО СТАДИИ     ################################
windows = []

for window in windows_all:
	window_phase = window.LookupParameter("Стадия возведения").AsValueString()
	if window_phase == input:
		windows.append(window)
####################################################################################

########################     ДВЕРИ ВСЕ В ПРОЕКТЕ ################################
doors_all = FilteredElementCollector(doc).OfCategory(BuiltInCategory.OST_Doors).WhereElementIsNotElementType().ToElements()
########################     ДВЕРИ ПО СТАДИИ     ################################
doors = []

for door in doors_all:
	door_phase = door.LookupParameter("Стадия возведения").AsValueString()
	if door_phase == input:
		doors.append(door)
####################################################################################

#rooms = UnwrapElement(IN[3])


def get_S(window):
	h=None
	list=[]
	type = doc.GetElement(window.get_Parameter(BuiltInParameter.ELEM_TYPE_PARAM).AsElementId())
	for par in pars:
		if par[2]=="Т":
			el = type
		else:
			el = window
		w = el.LookupParameter(par[0])
		h = el.LookupParameter(par[1])
		list.append([w,h])
		S = 0
		if w is not None and h is not None and w.AsDouble() != 0 and h.AsDouble() != 0:
			S = w.AsDouble()*h.AsDouble()
			break
	return S
def get_id(d1):
	id=0
	try:
		id= d1.Id
	except:
		id=0
	return id		
def to_dict(id,window):
	if id!=0:
		S=get_S(window)
		if id not in dict:
			dict[id]=S
		else:
			dict[id]+=S
	return dict	
def add_S(windows):
	for window in windows:
		phase = doc.GetElement(rooms[0].get_Parameter(BuiltInParameter.ROOM_PHASE).AsElementId())
		d1 = window.FromRoom[phase]
		d2 = window.ToRoom[phase]	
		id1 = str(get_id(d1))
		to_dict(id1,window)	
		id2 = str(get_id(d2))
		to_dict(id2,window)
	return dict			
#
dict={}
list=[]
add_S(windows)
add_S(doors)

list_test = []
for room in rooms:
	if room.Area>0:
		id = room.Id
		if str(id) in dict:
			S = dict[str(id)]
		else:
			S=0		
		bounds = room.GetBoundarySegments(opt)
		for contour in bounds:
			for bound in contour:
				el = doc.GetElement(bound.ElementId)
				list_test.append(el)
				if el is not None:					
					type = el.GetType().Name
					if type == 'ModelLine':
						S = S + room.UnboundedHeight*bound.GetCurve().Length
					try:	
						if el.CurtainGrid is not None:
							S = S+room.UnboundedHeight*bound.GetCurve().Length
					except:
						0				
					
			room.LookupParameter(pS).Set(S)				
TransactionManager.Instance.TransactionTaskDone()		
#Назначьте вывод переменной OUT"""	
OUT = rooms, windows, doors, input, list_test
# ----------------------------------------
