# Dynamo graph PGS_СеткаКладкаСтена.dyn (Dynamo 2.10.1.3976)

# group: ИМПОРТ
# note: Используйте этот цвет группы для узлов, применяемых с целью импорта геометрии.

# group: ВЫВОД
# note: Используйте этот цвет группы для узлов, применяемых с целью создания элементов Revit.

# group: PYTHON
# note: Используйте этот цвет группы для узлов Python и других узлов, связанных со сценарием.

# group: ВХОДНЫЕ ДАННЫЕ
# note: Используйте этот цвет группы для входных данных программ (регуляторы, блоки кода и т.д.).

# group: ПРОЕКТ
# note: Используйте этот цвет группы для функций программы.

# group: Все стены в проекте
# note: Описание проекта и назначение программы Dynamo
categories = Categories("OST_Walls")
all_elements_of_category = ElementsOfCategory(Category=categories)

# group: Группировка стен по Типу
code_block = CodeBlock { "Тип"; }
getParameterValueByName = Element.GetParameterValueByName(element=all_elements_of_category, parameterName=code_block)
groupByKey = List.GroupByKey(list=all_elements_of_category, keys=getParameterValueByName)
list_create = List.Create(item0=groupByKey.groups)

# group: Группировка стен по ТипАрмирования (сетка или арматура)
code_block_2 = CodeBlock { "Арм.ТипАрмирования"; }
getParameterValueByName_2 = Element.GetParameterValueByName(element=list_create, parameterName=code_block_2)
groupByKey_2 = List.GroupByKey(list=list_create@L2, keys=getParameterValueByName_2@L2)
list_create_2 = List.Create(item0=groupByKey_2.groups)
code_block_3 = CodeBlock { 2; }
flatten = List.Flatten(list=list_create_2, amt=code_block_3)

# group: Список ТиповАрмирования стен
code_block_4 = CodeBlock { "Арм.ТипАрмирования"; }
getParameterValueByName_3 = Element.GetParameterValueByName(element=flatten@L2, parameterName=code_block_4)

# group: Стены с ТипАрмирования = 1 (сетка)
code_block_5 = CodeBlock { 1; }
eq = getParameterValueByName_3 == code_block_5
filterByBoolMask = List.FilterByBoolMask(list=flatten, mask=eq)
list_create_3 = List.Create(item0=filterByBoolMask.in)
code_block_6 = CodeBlock { 1; }
flatten_2 = List.Flatten(list=list_create_3, amt=code_block_6)
clean = List.Clean(list=flatten_2)

code_block_7 = CodeBlock { 2; }
flatten_3 = List.Flatten(list=clean, amt=code_block_7)

# group: Компоновка значения для Мрк.ОбозначениеСетки
code_block_8 = CodeBlock { "Арм.ГоризДиаметр"; }
getParameterValueByName_4 = Element.GetParameterValueByName(element=flatten_3, parameterName=code_block_8)
string_from_object = FromObject(object=getParameterValueByName_4)
code_block_9 = CodeBlock { ",000000"; }
split = String.Split(str=string_from_object, separator0=code_block_9)
code_block_10 = CodeBlock { 5; }
flatten_4 = List.Flatten(list=split, amt=code_block_10)
code_block_11 = CodeBlock { "Арм.КлассСтали"; }
getParameterValueByName_5 = Element.GetParameterValueByName(element=flatten_3, parameterName=code_block_11)
flatten_5 = List.Flatten(list=getParameterValueByName_5, amt=code_block_10)
code_block_12 = CodeBlock { "Арм.ШагОснНапрСетки"; }
getParameterValueByName_6 = Element.GetParameterValueByName(element=flatten_3, parameterName=code_block_12)
string_from_object_2 = FromObject(object=getParameterValueByName_6)
code_block_13 = CodeBlock { ",000000"; }
split_2 = String.Split(str=string_from_object_2, separator0=code_block_13)
flatten_6 = List.Flatten(list=split_2, amt=code_block_10)
code_block_14 = CodeBlock { "Арм.ОчереднАрмирРядовКладки"; }
getParameterValueByName_7 = Element.GetParameterValueByName(element=flatten_3, parameterName=code_block_14)
string_from_object_3 = FromObject(object=getParameterValueByName_7)
code_block_15 = CodeBlock { ",000000"; }
split_3 = String.Split(str=string_from_object_3, separator0=code_block_15)
flatten_7 = List.Flatten(list=split_3, amt=code_block_10)
code_block_16 = CodeBlock(Диаметр=flatten_4, КлассСтали=flatten_5, Шаг=flatten_6, РядыАрм=flatten_7) { "Сетка кладочная Ø" + Диаметр + " мм " + КлассСтали + ", ячейка " + Шаг +"x" + Шаг + " мм каждые " +РядыАрм+ " ряда кладки"; }

# group: Присвоение параметра Мрк.НаименованиеСетки
code_block_17 = CodeBlock { "Мрк.НаименованиеСетки"; }
setParameterByName = Element.SetParameterByName(element=flatten_3, parameterName=code_block_17, value=code_block_16)

# group: Стены с ТипАрмирования = 2 (арматура)
code_block_18 = CodeBlock { 2; }
eq_2 = getParameterValueByName_3 == code_block_18
filterByBoolMask_2 = List.FilterByBoolMask(list=flatten, mask=eq_2)
list_create_4 = List.Create(item0=filterByBoolMask_2.in)
code_block_19 = CodeBlock { 1; }
flatten_8 = List.Flatten(list=list_create_4, amt=code_block_19)
clean_2 = List.Clean(list=flatten_8)

# group: Компоновка значения для Мрк.ОбозначениеСетки
code_block_20 = CodeBlock { "Арм.КолвоСтержнейКладки"; }
getParameterValueByName_8 = Element.GetParameterValueByName(element=clean_2, parameterName=code_block_20)
string_from_object_4 = FromObject(object=getParameterValueByName_8)
code_block_21 = CodeBlock { "Арм.ГоризДиаметр"; }
getParameterValueByName_9 = Element.GetParameterValueByName(element=clean_2, parameterName=code_block_21)
string_from_object_5 = FromObject(object=getParameterValueByName_9)
code_block_22 = CodeBlock { ",000000"; }
split_4 = String.Split(str=string_from_object_5, separator0=code_block_22)
code_block_23 = CodeBlock { "Арм.КлассСтали"; }
getParameterValueByName_10 = Element.GetParameterValueByName(element=clean_2, parameterName=code_block_23)
code_block_24 = CodeBlock { "Арм.ОчереднАрмирРядовКладки"; }
getParameterValueByName_11 = Element.GetParameterValueByName(element=clean_2, parameterName=code_block_24)
string_from_object_6 = FromObject(object=getParameterValueByName_11)
code_block_25 = CodeBlock(КолвоСтержней=string_from_object_4, Диаметр=split_4, КлассСтали=getParameterValueByName_10, АрмРяды=string_from_object_6) { КолвоСтержней + " стержня Ø" + Диаметр + " " + КлассСтали + " каждые " + АрмРяды; }
code_block_26 = CodeBlock { ",000000"; }
split_5 = String.Split(str=code_block_25, separator0=code_block_26)
code_block_27 = CodeBlock(Начало=split_5) { Начало + " ряда кладки"; }

# group: Присвоение параметра Мрк.НаименованиеСетки
code_block_28 = CodeBlock { "Мрк.НаименованиеСетки"; }
setParameterByName_2 = Element.SetParameterByName(element=clean_2, parameterName=code_block_28, value=code_block_27)

# group: Присвоение параметра Мрк.ОбозначениеСетки
code_block_29 = CodeBlock { "Мрк.ОбозначениеСетки"; }
а500_гост = CodeBlock { "ГОСТ 34028-2016"; }
setParameterByName_3 = Element.SetParameterByName(element=clean_2, parameterName=code_block_29, value=а500_гост)

# group: Присвоение параметра Мрк.ОбозначениеСетки
code_block_30 = CodeBlock { "Мрк.ОбозначениеСетки"; }
сетка_гост = CodeBlock { "ГОСТ 23279-2012"; }
setParameterByName_4 = Element.SetParameterByName(element=flatten_3, parameterName=code_block_30, value=сетка_гост)
