# Dynamo graph PGS_СеткаКладкаЧасти.dyn (Dynamo 2.10.1.3976)
# packages: Zebra 2016.7.2

# group: ИМПОРТ
# note: Используйте этот цвет группы для узлов, применяемых с целью импорта геометрии.

# group: ВЫВОД
# note: Используйте этот цвет группы для узлов, применяемых с целью создания элементов Revit.

# group: PYTHON
# note: Используйте этот цвет группы для узлов Python и других узлов, связанных со сценарием.

# group: ВХОДНЫЕ ДАННЫЕ
# note: Используйте этот цвет группы для входных данных программ (регуляторы, блоки кода и т.д.).

# group: ПРОЕКТ
# note: Используйте этот цвет группы для функций программы.

# group: Все части в проекте
categories = Categories("OST_Parts")
all_elements_of_category = ElementsOfCategory(Category=categories)

# group: Создание списка имен рабочих наборов частей
parameters = Element.Parameters(element=all_elements_of_category)
code_block = CodeBlock { 37; }
getItemAtIndex = List.GetItemAtIndex(index=code_block)  # unwired: list
map = List.Map(list=parameters, function=getItemAtIndex)
string_from_object = FromObject(object=map)
code_block_2 = CodeBlock { 0; }
code_block_3 = CodeBlock { 16; }
remove = String.Remove(string=string_from_object, startIndex=code_block_2, count=code_block_3)

# group: Выбор частей по рабочему набору
вы_работаете_в_связанном_файле = BoolSelector(true)  # graph input
рабочий_набор = StringInput("Рабочий набор 1")  # graph input
eq = remove == рабочий_набор
filterByBoolMask = List.FilterByBoolMask(list=all_elements_of_category, mask=eq)
if_ = Custom[Logic.If](test=вы_работаете_в_связанном_файле, ifTrue=filterByBoolMask.in, ifFalse=all_elements_of_category)  # package Zebra; Retains the old status of the previous built-in IF node.

# group: Фильтр частей, материал, имена материала у которых начинаются с 04
getMaterials = Element.GetMaterials(element=if_)
code_block_4 = CodeBlock { "Имя"; }
getParameterValueByName = Element.GetParameterValueByName(element=getMaterials, parameterName=code_block_4)
code_block_5 = CodeBlock { 0; 2; }
substring = String.Substring(str=getParameterValueByName, startIndex=code_block_5.out0, length=code_block_5.out1)
code_block_6 = CodeBlock { "04"; }
eq_2 = substring == code_block_6
code_block_7 = CodeBlock { 20; }
flatten = List.Flatten(list=eq_2, amt=code_block_7)
# note: Описание проекта и назначение программы Dynamo
filterByBoolMask_2 = List.FilterByBoolMask(list=if_, mask=flatten)

# group: Группировка частей по Исходному типу
code_block_8 = CodeBlock { "Исходный тип"; }
getParameterValueByName_2 = Element.GetParameterValueByName(element=filterByBoolMask_2.in, parameterName=code_block_8)
groupByKey = List.GroupByKey(list=filterByBoolMask_2.in, keys=getParameterValueByName_2)
list_create = List.Create(item0=groupByKey.groups)

# group: Группировка стен по ТипАрмирования (сетка или арматура)
code_block_9 = CodeBlock { "Арм.ТипАрмирования"; }
getParameterValueByName_3 = Element.GetParameterValueByName(element=list_create, parameterName=code_block_9)
groupByKey_2 = List.GroupByKey(list=list_create@L2, keys=getParameterValueByName_3@L2)
list_create_2 = List.Create(item0=groupByKey_2.groups)
code_block_10 = CodeBlock { 2; }
flatten_2 = List.Flatten(list=list_create_2, amt=code_block_10)

# group: Список ТиповАрмирования стен
code_block_11 = CodeBlock { "Арм.ТипАрмирования"; }
getParameterValueByName_4 = Element.GetParameterValueByName(element=flatten_2@L2, parameterName=code_block_11)

# group: Стены с ТипАрмирования = 1 (сетка)
code_block_12 = CodeBlock { 1; }
eq_3 = getParameterValueByName_4 == code_block_12
filterByBoolMask_3 = List.FilterByBoolMask(list=flatten_2, mask=eq_3)
list_create_3 = List.Create(item0=filterByBoolMask_3.in)
code_block_13 = CodeBlock { 20; }
flatten_3 = List.Flatten(list=list_create_3, amt=code_block_13)
clean = List.Clean(list=flatten_3)

# group: Компоновка значения для Мрк.ОбозначениеСетки
code_block_14 = CodeBlock { "Арм.ГоризДиаметр"; }
getParameterValueByName_5 = Element.GetParameterValueByName(element=clean, parameterName=code_block_14)
string_from_object_2 = FromObject(object=getParameterValueByName_5)
code_block_15 = CodeBlock { ",000000"; }
split = String.Split(str=string_from_object_2, separator0=code_block_15)
code_block_16 = CodeBlock { "Арм.КлассСтали"; }
getParameterValueByName_6 = Element.GetParameterValueByName(element=clean, parameterName=code_block_16)
code_block_17 = CodeBlock { "Арм.ШагОснНапрСетки"; }
getParameterValueByName_7 = Element.GetParameterValueByName(element=clean, parameterName=code_block_17)
string_from_object_3 = FromObject(object=getParameterValueByName_7)
code_block_18 = CodeBlock { ",000000"; }
split_2 = String.Split(str=string_from_object_3, separator0=code_block_18)
code_block_19 = CodeBlock { "Арм.ОчереднАрмирРядовКладки"; }
getParameterValueByName_8 = Element.GetParameterValueByName(element=clean, parameterName=code_block_19)
string_from_object_4 = FromObject(object=getParameterValueByName_8)
code_block_20 = CodeBlock { ",000000"; }
split_3 = String.Split(str=string_from_object_4, separator0=code_block_20)
code_block_21 = CodeBlock(Диаметр=split, КлассСтали=getParameterValueByName_6, Шаг=split_2, РядыАрм=split_3) { "Сетка кладочная Ø" + Диаметр + " мм " + КлассСтали + ", ячейка " + Шаг +"x" + Шаг + " мм каждые " +РядыАрм+ " ряда кладки"; }

# group: Присвоение параметра Мрк.НаименованиеСетки
code_block_22 = CodeBlock { "Мрк.НаименованиеСетки"; }
setParameterByName = Element.SetParameterByName(element=clean, parameterName=code_block_22, value=code_block_21)

# group: Стены с ТипАрмирования = 2 (арматура)
code_block_23 = CodeBlock { 2; }
eq_4 = getParameterValueByName_4 == code_block_23
filterByBoolMask_4 = List.FilterByBoolMask(list=flatten_2, mask=eq_4)
list_create_4 = List.Create(item0=filterByBoolMask_4.in)
code_block_24 = CodeBlock { 20; }
flatten_4 = List.Flatten(list=list_create_4, amt=code_block_24)
clean_2 = List.Clean(list=flatten_4)

# group: Компоновка значения для Мрк.ОбозначениеСетки
code_block_25 = CodeBlock { "Арм.КолвоСтержнейКладки"; }
getParameterValueByName_9 = Element.GetParameterValueByName(element=clean_2, parameterName=code_block_25)
string_from_object_5 = FromObject(object=getParameterValueByName_9)
code_block_26 = CodeBlock { "Арм.ГоризДиаметр"; }
getParameterValueByName_10 = Element.GetParameterValueByName(element=clean_2, parameterName=code_block_26)
string_from_object_6 = FromObject(object=getParameterValueByName_10)
code_block_27 = CodeBlock { ",000000"; }
split_4 = String.Split(str=string_from_object_6, separator0=code_block_27)
code_block_28 = CodeBlock { "Арм.КлассСтали"; }
getParameterValueByName_11 = Element.GetParameterValueByName(element=clean_2, parameterName=code_block_28)
code_block_29 = CodeBlock { "Арм.ОчереднАрмирРядовКладки"; }
getParameterValueByName_12 = Element.GetParameterValueByName(element=clean_2, parameterName=code_block_29)
string_from_object_7 = FromObject(object=getParameterValueByName_12)
code_block_30 = CodeBlock(КолвоСтержней=string_from_object_5, Диаметр=split_4, КлассСтали=getParameterValueByName_11, АрмРяды=string_from_object_7) { КолвоСтержней + " стержня Ø" + Диаметр + " " + КлассСтали + " каждые " + АрмРяды; }
code_block_31 = CodeBlock { ",000000"; }
split_5 = String.Split(str=code_block_30, separator0=code_block_31)
code_block_32 = CodeBlock(Начало=split_5) { Начало + " ряда кладки"; }

# group: Присвоение параметра Мрк.НаименованиеСетки
code_block_33 = CodeBlock { "Мрк.НаименованиеСетки"; }
setParameterByName_2 = Element.SetParameterByName(element=clean_2, parameterName=code_block_33, value=code_block_32)

# group: Присвоение параметра Мрк.ОбозначениеСетки
code_block_34 = CodeBlock { "Мрк.ОбозначениеСетки"; }
а500_гост = CodeBlock { "ГОСТ 34028-2016"; }
setParameterByName_3 = Element.SetParameterByName(element=clean_2, parameterName=code_block_34, value=а500_гост)

# group: Присвоение параметра Мрк.ОбозначениеСетки
code_block_35 = CodeBlock { "Мрк.ОбозначениеСетки"; }
сетка_гост = CodeBlock { "ГОСТ 23279-2012"; }
setParameterByName_4 = Element.SetParameterByName(element=clean, parameterName=code_block_35, value=сетка_гост)
