# Dynamo graph 00_BIM_Создание перечня проверок по матрице коллизий.dyn (Dynamo 2.10.1.3976)
# packages: Zhukoven.com 2019.5.7, Clockwork for Dynamo 2.x 2.3.0

# group: Задать путь к файлу матрицы
file_path = Filename(".\Матрица проверок на коллизии (v2).xlsx")

fromPath = FileObject(path=file_path)  # "File.FromPath"
code_block = CodeBlock()
# ---------- code_block.designscript (7 lines) ----------
//Наименовние листа с матрицей коллизий
"Матрица проверок на коллизии";
//Наименование листа с приоритетами разделов
"Приоритеты";
//Наименование листа с расшифровкой номеров коллизий
//из матрицы проверок
"Мэппинг проверок";
# ----------------------------------------

# group: Получение таблицы приоритетов и создание словаря
importExcel = Data.ImportExcel(file=fromPath, sheetName=code_block.out1)
restOfItems = List.RestOfItems(list=importExcel)
firstItem = List.FirstItem(list=restOfItems@L2)
restOfItems_2 = List.RestOfItems(list=restOfItems@L2)
flatten = List.Flatten(list=restOfItems_2)
byKeysValues = DesignScript.Builtin.Dictionary.ByKeysValues(keys=firstItem, values=flatten)

importExcel_2 = Data.ImportExcel(file=fromPath, sheetName=code_block.out0)

# group: Исключение заголовков столбцов
code_block_2 = CodeBlock { 2; }
dropItems = List.DropItems(list=importExcel_2, amount=code_block_2)

# group: Исключение заголовков строк
code_block_3 = CodeBlock { 2; }
dropItems_2 = List.DropItems(list=dropItems@L2, amount=code_block_3)

# group: Получение индексов ненулевых ячеек
isNull = Object.IsNull(object=dropItems_2@L2)
code_block_4 = CodeBlock { false; }
allIndicesOf = List.AllIndicesOf(list=isNull@L2, item=code_block_4)

# group: Получение номеров проверок
filterByBoolMask = List.FilterByBoolMask(list=dropItems_2, mask=isNull)
string_from_object = FromObject(obj=filterByBoolMask.out)
code_block_5 = CodeBlock { ",000000"; ""; }
replace = String.Replace(string=string_from_object, searchFor=code_block_5.out0, replaceWith=code_block_5.out1)
split = String.Split(str=replace, separator0=code_block_5.out1)
flatten_2 = List.Flatten(list=split@L3)
count = List.Count(list=split@L2)
flatten_3 = List.Flatten(list=flatten_2)

count_2 = List.Count(list=flatten_2@L2)

# group: Получение наименований разделов из строк
code_block_6 = CodeBlock { 0; }
getItemAtIndex = List.GetItemAtIndex(list=dropItems@L2, index=code_block_6)
multiplyByAnotherList = Custom[List.MultiplyByAnotherList](item=getItemAtIndex, amount=count_2)  # package Zhukoven.com; Multiplies each item of a given list by unique number given in another list. Works for equal lists
flatten_4 = List.Flatten(list=multiplyByAnotherList)

# group: Создание последовательности приоритетов строк
valueAtKey = DesignScript.Builtin.Dictionary.ValueAtKey(dictionary=byKeysValues, key=flatten_4)
code_block_7 = CodeBlock { 0; }
replaceNull = Custom[List.ReplaceNull](seq=valueAtKey, replacement=code_block_7)  # package Clockwork for Dynamo 2.x; Replaces all null values within a given list with a substitute

count_3 = List.Count(list=dropItems)

# group: Получение наименований разделов из столбцов
firstItem_2 = List.FirstItem(list=importExcel_2)
code_block_8 = CodeBlock { 2; }
dropItems_3 = List.DropItems(list=firstItem_2, amount=code_block_8)
ofRepeatedItem = List.OfRepeatedItem(item=dropItems_3, amount=count_3)
getItemAtIndex_2 = List.GetItemAtIndex(list=ofRepeatedItem@L2, index=allIndicesOf@L2)
flatten_5 = List.Flatten(list=getItemAtIndex_2)
multiplyByAnotherList_2 = Custom[List.MultiplyByAnotherList](item=flatten_5, amount=count)
flatten_6 = List.Flatten(list=multiplyByAnotherList_2)

# group: Создание последовательности приоритетов столбцов
valueAtKey_2 = DesignScript.Builtin.Dictionary.ValueAtKey(dictionary=byKeysValues, key=flatten_6)
code_block_9 = CodeBlock { 0; }
replaceNull_2 = Custom[List.ReplaceNull](seq=valueAtKey_2, replacement=code_block_9)

ge = replaceNull >= replaceNull_2

# group: Приоритеты
if_ = If(test=ge, true=replaceNull, false=replaceNull_2)
string_from_object_2 = FromObject(obj=if_)
code_block_10 = CodeBlock { ",000000"; ""; }
replace_2 = String.Replace(string=string_from_object_2, searchFor=code_block_10.out0, replaceWith=code_block_10.out1)

# group: Раздел1
if_2 = If(test=ge, true=flatten_4, false=flatten_6)

# group: Раздел2
if_3 = If(test=ge, true=flatten_6, false=flatten_4)

# group: Получение описаний проверок и создание словарей
importExcel_3 = Data.ImportExcel(file=fromPath, sheetName=code_block.out2)
restOfItems_3 = List.RestOfItems(list=importExcel_3)
firstItem_3 = List.FirstItem(list=restOfItems_3@L2)
string_from_object_3 = FromObject(obj=firstItem_3)
code_block_11 = CodeBlock { ",000000"; ""; }
replace_3 = String.Replace(string=string_from_object_3, searchFor=code_block_11.out0, replaceWith=code_block_11.out1)
code_block_12 = CodeBlock { 2; }
getItemAtIndex_3 = List.GetItemAtIndex(list=restOfItems_3@L2, index=code_block_12)
code_block_13 = CodeBlock { 1; }
getItemAtIndex_4 = List.GetItemAtIndex(list=restOfItems_3@L2, index=code_block_13)
byKeysValues_2 = DesignScript.Builtin.Dictionary.ByKeysValues(keys=replace_3, values=getItemAtIndex_4)

lastItem = List.LastItem(list=restOfItems_3@L2)

# group (continued): Получение описаний проверок и создание словарей
flatten_7 = List.Flatten(list=lastItem)
list_create = List.Create(item0=getItemAtIndex_3, item1=flatten_7)
transpose = List.Transpose(lists=list_create)
byKeysValues_3 = DesignScript.Builtin.Dictionary.ByKeysValues(keys=replace_3, values=flatten_7)

# group: Может возникать предупреждение, если допуск 0
join = String.Join(separator=code_block_11.out1, string0=transpose)

# group (continued): Получение описаний проверок и создание словарей
flatten_8 = List.Flatten(list=join)
byKeysValues_4 = DesignScript.Builtin.Dictionary.ByKeysValues(keys=replace_3, values=flatten_8)

valueAtKey_3 = DesignScript.Builtin.Dictionary.ValueAtKey(dictionary=byKeysValues_4, key=flatten_3)

# group: Получение категорий из строк
code_block_14 = CodeBlock { 1; }
getItemAtIndex_5 = List.GetItemAtIndex(list=dropItems@L2, index=code_block_14)
multiplyByAnotherList_3 = Custom[List.MultiplyByAnotherList](item=getItemAtIndex_5, amount=count_2)
flatten_9 = List.Flatten(list=multiplyByAnotherList_3)

# group: Получение категорий из столбцов
code_block_15 = CodeBlock { 1; }
getItemAtIndex_6 = List.GetItemAtIndex(list=importExcel_2, index=code_block_15)
code_block_16 = CodeBlock { 2; }
dropItems_4 = List.DropItems(list=getItemAtIndex_6, amount=code_block_16)
ofRepeatedItem_2 = List.OfRepeatedItem(item=dropItems_4, amount=count_3)
getItemAtIndex_7 = List.GetItemAtIndex(list=ofRepeatedItem_2@L2, index=allIndicesOf@L2)
flatten_10 = List.Flatten(list=getItemAtIndex_7)
multiplyByAnotherList_4 = Custom[List.MultiplyByAnotherList](item=flatten_10, amount=count)
flatten_11 = List.Flatten(list=multiplyByAnotherList_4)

# group: Категория1
if_4 = If(test=ge, true=flatten_9, false=flatten_11)

# group: Категория2
if_5 = If(test=ge, true=flatten_11, false=flatten_9)

valueAtKey_4 = DesignScript.Builtin.Dictionary.ValueAtKey(dictionary=byKeysValues_3, key=flatten_3)
valueAtKey_5 = DesignScript.Builtin.Dictionary.ValueAtKey(dictionary=byKeysValues_2, key=flatten_3)

# group: Создание наименований проверок и поисковых наборов и запись на лист "Проверки"
code_block_17 = CodeBlock { "Проверки"; }
code_block_18 = CodeBlock { 1; 0; false; }
code_block_19 = CodeBlock { "_"; }
create = List.Create(item0=replace_2, item1=if_2, item2=if_3, item3=valueAtKey_3, item4=if_4, item5=if_5)
transpose_2 = List.Transpose(lists=create)
join_2 = String.Join(separator=code_block_19, string0=transpose_2)
flatten_12 = List.Flatten(list=join_2)
code_block_20 = CodeBlock { "_"; }
create_2 = List.Create(item0=if_2, item1=if_4)
transpose_3 = List.Transpose(lists=create_2)
join_3 = String.Join(separator=code_block_20, string0=transpose_3)
flatten_13 = List.Flatten(list=join_3)
code_block_21 = CodeBlock { "_"; }
create_3 = List.Create(item0=if_3, item1=if_5)
transpose_4 = List.Transpose(lists=create_3)
join_4 = String.Join(separator=code_block_21, string0=transpose_4)
flatten_14 = List.Flatten(list=join_4)
create_4 = List.Create(item0=flatten_12, item1=flatten_13, item2=flatten_14, item3=valueAtKey_4, item4=valueAtKey_5)
transpose_5 = List.Transpose(lists=create_4)
exportExcel = Data.ExportExcel(filePath=file_path, sheetName=code_block_17, startRow=code_block_18.out0, startCol=code_block_18.out1, data=transpose_5, overWrite=code_block_18.out2)

# group: Заполнение листа "Поисковые наборы" для последующего формирования правил
code_block_22 = CodeBlock { "Поисковые наборы"; }
code_block_23 = CodeBlock { 1; 0; false; }
join_5 = List.Join(list0=flatten_13, list1=flatten_14)
uniqueItems = List.UniqueItems(list=join_5)
code_block_24 = CodeBlock { "_"; }
split_2 = String.Split(str=uniqueItems, separator0=code_block_24)
firstItem_4 = List.FirstItem(list=split_2@L2)
lastItem_2 = List.LastItem(list=split_2@L2)
create_5 = List.Create(item0=uniqueItems, item1=firstItem_4, item2=lastItem_2)
transpose_6 = List.Transpose(lists=create_5)
exportExcel_2 = Data.ExportExcel(filePath=file_path, sheetName=code_block_22, startRow=code_block_23.out0, startCol=code_block_23.out1, data=transpose_6, overWrite=code_block_23.out2)
