# Dynamo graph 00_BIM_Создание файла XML (v3) с проверками по перечню проверок и поисковых наборов.dyn (Dynamo 2.10.1.3976)

# group: Исходные данные
code_block = CodeBlock()
# ---------- code_block.designscript (2 lines) ----------
//Путь для сохранения файла
"Q:\\!BIM\\Скрипты\\ClushDetective\\ClashDetectiveTemplate_v1.xml";
# ----------------------------------------
code_block_2 = CodeBlock()
# ---------- code_block_2.designscript (2 lines) ----------
//Имя файла без пробелов (вместо пробела использовать нижнее подчеркинвание)
"ClashDetectiveTemplate_v1";
# ----------------------------------------
# note: Путь к матрице коллизий
file_path = Filename(".\Матрица проверок на коллизии (v2).xlsx")
code_block_3 = CodeBlock()
# ---------- code_block_3.designscript (4 lines) ----------
//Наименование листа с перечнем проверок
"Проверки";
//Наименование листа с перечнем поисковых наборов
"Поисковые наборы";
# ----------------------------------------

file_from_path = FileObject(path=file_path)
importExcel = Data.ImportExcel(file=file_from_path, sheetName=code_block_3.out0)

# group: Перечень проверок
code_block_4 = CodeBlock { ""; }
restOfItems = List.RestOfItems(list=importExcel)
firstItem = List.FirstItem(list=restOfItems@L2)
lastItem = List.LastItem(list=restOfItems@L2)
code_block_5 = CodeBlock { 3; }
getItemAtIndex = List.GetItemAtIndex(list=restOfItems@L2, index=code_block_5)
code_block_6 = CodeBlock { 1; }
getItemAtIndex_2 = List.GetItemAtIndex(list=restOfItems@L2, index=code_block_6)
code_block_7 = CodeBlock { 2; }
getItemAtIndex_3 = List.GetItemAtIndex(list=restOfItems@L2, index=code_block_7)
code_block_8 = CodeBlock(ClashtestName=firstItem, TestType=lastItem, Tolerance=getItemAtIndex, LeftSelectionSet=getItemAtIndex_2, RightSelectionSet=getItemAtIndex_3)
# ---------- code_block_8.designscript (14 lines) ----------
" <clashtest name=\""+ClashtestName+"\" test_type=\""+TestType+"\" status=\"new\" tolerance=\""+Tolerance+"\" merge_composites=\"1\">
        <linkage mode=\"none\"/>
        <left>
          <clashselection selfintersect=\"0\" primtypes=\"1\">
            <locator>lcop_selection_set_tree/"+LeftSelectionSet+"</locator>
          </clashselection>
        </left>
        <right>
          <clashselection selfintersect=\"0\" primtypes=\"1\">
            <locator>lcop_selection_set_tree/"+RightSelectionSet+"</locator>
          </clashselection>
        </right>
        <rules/>
      </clashtest>";
# ----------------------------------------
join = String.Join(separator=code_block_4, string0=code_block_8)

importExcel_2 = Data.ImportExcel(file=file_from_path, sheetName=code_block_3.out1)

# group: Перечень наборов
code_block_9 = CodeBlock { ""; }
restOfItems_2 = List.RestOfItems(list=importExcel_2)
firstItem_2 = List.FirstItem(list=restOfItems_2@L2)
lastItem_2 = List.LastItem(list=restOfItems_2@L2)
code_block_10 = CodeBlock { 1; }
getItemAtIndex_4 = List.GetItemAtIndex(list=restOfItems_2@L2, index=code_block_10)
code_block_11 = CodeBlock(SelectionsetName=firstItem_2, CategoryName=lastItem_2, DocumentTitleContains=getItemAtIndex_4)
# ---------- code_block_11.designscript (26 lines) ----------
"<selectionset name=\""+SelectionsetName+"\" guid=\"\">
        <findspec mode=\"all\" disjoint=\"0\">
          <conditions>
            <condition test=\"equals\" flags=\"10\">
              <category>
                <name internal=\"LcRevitData_Element\">Объект</name>
              </category>
              <property>
                <name internal=\"LcRevitPropertyElementCategory\">Категория</name>
              </property>
              <value>
                <data type=\"wstring\">"+CategoryName+"</data>
              </value>
            </condition>
            <condition test=\"contains\" flags=\"10\">
              <property>
                <name internal=\"LcOaNodeSourceFile\">Файл источника</name>
              </property>
              <value>
                <data type=\"wstring\">"+DocumentTitleContains+"</data>
              </value>
            </condition>
          </conditions>
          <locator>/</locator>
        </findspec>
      </selectionset>";
# ----------------------------------------
join_2 = String.Join(separator=code_block_9, string0=code_block_11)

code_block_12 = CodeBlock(FileName=code_block_2, FilePath=code_block, Clashtests=join, Selectionsets=join_2)
# ---------- code_block_12.designscript (8 lines) ----------
"<?xml version=\"1.0\" encoding=\"UTF-8\" ?>

<exchange xmlns:xsi=\"http://www.w3.org/2001/XMLSchema-instance\" xsi:noNamespaceSchemaLocation=\"http://download.autodesk.com/us/navisworks/schemas/nw-exchange-12.0.xsd\" units=\"m\" filename=\""+FileName+"\" filepath=\""+FilePath+"\">
  <batchtest name=\""+FileName+"\" internal_name=\""+FileName+"\" units=\"m\">
    <clashtests>"+Clashtests+"</clashtests>
    <selectionsets>"+Selectionsets+"</selectionsets>
  </batchtest>
</exchange>";
# ----------------------------------------
exportCSV = Data.ExportCSV(filePath=code_block, data=code_block_12)
