# Dynamo graph PGS_00_DeleteSharedParams.dyn (Dynamo 2.10.1.3976)

# note: Описание проекта и назначение программы Dynamo

# group: ИМПОРТ
# note: Используйте этот цвет группы для узлов, применяемых с целью импорта геометрии.

# group: ВЫВОД
# note: Используйте этот цвет группы для узлов, применяемых с целью создания элементов Revit.

# group: PYTHON
# note: Используйте этот цвет группы для узлов Python и других узлов, связанных со сценарием.

# group: ВХОДНЫЕ ДАННЫЕ
# note: Используйте этот цвет группы для входных данных программ (регуляторы, блоки кода и т.д.).

# group: ПРОЕКТ
# note: Используйте этот цвет группы для функций программы.

путь_к_txt_файлу_через = CodeBlock { "D:\\Строганов В.Г\\REVIT\\! Скрипты в работе\\Обработка семейств\\parametersDelete.txt"; }

# group: Проверка на наличие txt файла
fileExists = FileSystem.FileExists(path=путь_к_txt_файлу_через)
code_block = CodeBlock { null; }
if_in_0_in_1_else_in_2 = Python(IN[0]=fileExists, IN[1]=путь_к_txt_файлу_через, IN[2]=code_block)  # IronPython2; graph output
# ---------- if_in_0_in_1_else_in_2.python (5 lines) ----------
if (IN[0]):
	out = IN[1]
else:
	out = IN[2]
OUT = out
# ----------------------------------------

# group: Получение списка названий параметров из txt файла
file_from_path = FileObject(path=if_in_0_in_1_else_in_2)
readText = FileSystem.ReadText(file=file_from_path)
code_block_2 = CodeBlock { "\n"; }
split = String.Split(str=readText, separator0=code_block_2)

# group: Удаление параметров из rfa файла
current = Document.Current()
byDocument = FamilyDocument.ByDocument(document=current)
deleteParameter = FamilyDocument.DeleteParameter(familyDocument=byDocument, parameterName=split, lacing=Longest)

описание_скрипта = StringInput("""1. В txt файле необходимо написать названия параметров для удаления.
2. Каждый параметр в отдельной строчке без кавычек и пробелов.""")  # graph input
