# Dynamo graph PGS_00_SharedParamsToFamily.dyn (Dynamo 2.10.1.3976)

# note: Описание проекта и назначение программы Dynamo

# group: ИМПОРТ
# note: Используйте этот цвет группы для узлов, применяемых с целью импорта геометрии.

# group: ВЫВОД
# note: Используйте этот цвет группы для узлов, применяемых с целью создания элементов Revit.

# group: PYTHON
# note: Используйте этот цвет группы для узлов Python и других узлов, связанных со сценарием.

# group: ВХОДНЫЕ ДАННЫЕ
# note: Используйте этот цвет группы для входных данных программ (регуляторы, блоки кода и т.д.).

# group: ПРОЕКТ
# note: Используйте этот цвет группы для функций программы.

# group: Описание
описание_скрипта = StringInput("""1. В txt файле необходимо написать названия общих параметров для изменения на параметры семейства.
2. Каждый параметр в отдельной строчке без кавычек и пробелов.""")  # graph input

# group: Получение параметров
получение_параметров_семейства = Python()  # IronPython2
# ---------- получение_параметров_семейства.python (41 lines) ----------
import clr
import sys
sys.path.append('C:\Program Files (x86)\IronPython 2.7\Lib')
import System
from System import Array
from System.Collections.Generic import *
clr.AddReference('ProtoGeometry')
from Autodesk.DesignScript.Geometry import *
clr.AddReference("RevitNodes")
import Revit
clr.ImportExtensions(Revit.Elements)
clr.ImportExtensions(Revit.GeometryConversion)
clr.AddReference("RevitServices")
import RevitServices
from RevitServices.Persistence import DocumentManager 
from RevitServices.Transactions import TransactionManager 

clr.AddReference("RevitAPI")
clr.AddReference("RevitAPIUI")

import Autodesk 
from Autodesk.Revit.DB import *
from Autodesk.Revit.UI import *

doc = DocumentManager.Instance.CurrentDBDocument
uiapp = DocumentManager.Instance.CurrentUIApplication 
app = uiapp.Application 
uidoc = uiapp.ActiveUIDocument

#######OK NOW YOU CAN CODE########

parameters = []
paramsNames = []

bo = doc.IsFamilyDocument
for param in doc.FamilyManager.Parameters:
	parameters.append(param)
	paramsNames.append(param.Definition.Name)
# "Start" the transaction

OUT = parameters, paramsNames
# ----------------------------------------
code_block = CodeBlock { 0; 1; }
параметры_семейства = List.GetItemAtIndex(list=получение_параметров_семейства, index=code_block.out0)
названия_параметров_семейства = List.GetItemAtIndex(list=получение_параметров_семейства, index=code_block.out1)

# group: Путь к файлу txt
полный_путь_к_txt_файлу_с = CodeBlock { "D:\\Строганов В.Г\\REVIT\\! Скрипты в работе\\Обработка семейств\\parametersChange.txt"; }  # "Полный путь к txt файлу с параметрами для изменения (через \\)"

# group: Проверка на наличие txt файла
fileExists = FileSystem.FileExists(path=полный_путь_к_txt_файлу_с)
code_block_2 = CodeBlock { null; }
if_in_0_in_1_else_in_2 = Python(IN[0]=fileExists, IN[1]=полный_путь_к_txt_файлу_с, IN[2]=code_block_2)  # IronPython2; graph output
# ---------- if_in_0_in_1_else_in_2.python (5 lines) ----------
if (IN[0]):
	out = IN[1]
else:
	out = IN[2]
OUT = out
# ----------------------------------------

# group: Получение списка названий параметров из txt файла
file_from_path = FileObject(path=if_in_0_in_1_else_in_2)
readText = FileSystem.ReadText(file=file_from_path)
code_block_3 = CodeBlock { "\n"; }
split = String.Split(str=readText, separator0=code_block_3)

# group: Фильтрация параметров семейства по txt файлу
поиск_названий_семейств = Python(IN[0]=названия_параметров_семейства, IN[1]=split)  # IronPython2
# ---------- поиск_названий_семейств.python (21 lines) ----------
paramsAll = IN[0]
paramsSearch = IN[1]

count = len(paramsAll)

boolList = []
for i in paramsAll:
	boolList.append(False)

for parSearch in paramsSearch:
	j = 0
	while j < count:
		boolList[j] = ((parSearch == paramsAll[j]) or boolList[j])
		j += 1
		

bool1 = paramsSearch[1] in paramsAll[21]
# Разместите код под этой строкой

# Назначьте вывод переменной OUT.
OUT = boolList
# ----------------------------------------
filterByBoolMask = List.FilterByBoolMask(list=параметры_семейства, mask=поиск_названий_семейств)

# group: Фильтрация shared параметров
получение_параметров_семейства_2 = Python(IN[0]=filterByBoolMask.in)  # IronPython2
# ---------- получение_параметров_семейства_2.python (36 lines) ----------
import clr
import sys
sys.path.append('C:\Program Files (x86)\IronPython 2.7\Lib')
import System
from System import Array
from System.Collections.Generic import *
clr.AddReference('ProtoGeometry')
from Autodesk.DesignScript.Geometry import *
clr.AddReference("RevitNodes")
import Revit
clr.ImportExtensions(Revit.Elements)
clr.ImportExtensions(Revit.GeometryConversion)
clr.AddReference("RevitServices")
import RevitServices
from RevitServices.Persistence import DocumentManager 
from RevitServices.Transactions import TransactionManager 

clr.AddReference("RevitAPI")
clr.AddReference("RevitAPIUI")

import Autodesk 
from Autodesk.Revit.DB import *
from Autodesk.Revit.UI import *

doc = DocumentManager.Instance.CurrentDBDocument
uiapp = DocumentManager.Instance.CurrentUIApplication 
app = uiapp.Application 
uidoc = uiapp.ActiveUIDocument

#######OK NOW YOU CAN CODE########

boolList = []
for i in IN[0]:
	boolList.append(i.IsShared)

OUT = boolList
# ----------------------------------------
filterByBoolMask_2 = List.FilterByBoolMask(list=filterByBoolMask.in, mask=получение_параметров_семейства_2)

# group: Shared parameters to Family parameters
изменение_shared_параметров_на = Python(IN[0]=filterByBoolMask_2.in)  # "Изменение shared параметров на family параметры"; IronPython2
# ---------- изменение_shared_параметров_на.python (46 lines) ----------
import clr
import sys
sys.path.append('C:\Program Files (x86)\IronPython 2.7\Lib')
import System
from System import Array
from System.Collections.Generic import *
clr.AddReference('ProtoGeometry')
from Autodesk.DesignScript.Geometry import *
clr.AddReference("RevitNodes")
import Revit
clr.ImportExtensions(Revit.Elements)
clr.ImportExtensions(Revit.GeometryConversion)
clr.AddReference("RevitServices")
import RevitServices
from RevitServices.Persistence import DocumentManager 
from RevitServices.Transactions import TransactionManager 

clr.AddReference("RevitAPI")
clr.AddReference("RevitAPIUI")

import Autodesk 
from Autodesk.Revit.DB import *
from Autodesk.Revit.UI import *

doc = DocumentManager.Instance.CurrentDBDocument
uiapp = DocumentManager.Instance.CurrentUIApplication 
app = uiapp.Application 
uidoc = uiapp.ActiveUIDocument

#######OK NOW YOU CAN CODE########


TransactionManager.Instance.EnsureInTransaction(doc)
output = []


for param in IN[0]:
	name = param.Definition.Name
	newPar = doc.FamilyManager.ReplaceParameter(param, "temp_"+param.Definition.Name, param.Definition.ParameterGroup, param.IsInstance)
	doc.FamilyManager.RenameParameter(newPar, name)
	output.append(newPar.Definition.Name)


TransactionManager.Instance.TransactionTaskDone()

OUT = output
# ----------------------------------------
