# Dynamo graph СМП_Кратко.dyn (Dynamo 1.3.4.6666)

code_block = CodeBlock()
# ---------- code_block.designscript (4 lines) ----------
{"OST_StructuralColumns",
"OST_StructuralFraming",
"OST_GenericModel",
"OST_StructConnections"};
# ----------------------------------------
byName = Category.ByName(code_block)
all_elements_of_category = ElementsOfCategory(byName)
code_block_2 = CodeBlock(list=all_elements_of_category) { List.Flatten(list, 1); }
code_block_3 = CodeBlock { "Тип"; }
getParameterValueByName = Element.GetParameterValueByName(element=code_block_2, parameterName=code_block_3)
code_block_4 = CodeBlock { "ADSK_Тип элемента КМ"; }
getParameterValueByName_2 = Element.GetParameterValueByName(element=getParameterValueByName, parameterName=code_block_4)
code_block_5 = CodeBlock(kss_list=getParameterValueByName_2) { kss_list==""; }
filterByBoolMask = List.FilterByBoolMask(list=getParameterValueByName, mask=code_block_5)
filterByBoolMask_2 = List.FilterByBoolMask(list=getParameterValueByName_2, mask=code_block_5)
code_block_6 = CodeBlock(kss_list=filterByBoolMask_2.out) { kss_list>1; }
filterByBoolMask_3 = List.FilterByBoolMask(list=filterByBoolMask.out, mask=code_block_6)
filterByBoolMask_4 = List.FilterByBoolMask(list=code_block_2, mask=code_block_5)
filterByBoolMask_5 = List.FilterByBoolMask(list=filterByBoolMask_4.out, mask=code_block_6)
code_block_7 = CodeBlock(list1=filterByBoolMask_3.in, list2=filterByBoolMask_5.in) { List.Flatten(list1, 1); List.Flatten(list2, 1); }
code_block_8 = CodeBlock { "ADSK_Наименование профиля"; }
getParameterValueByName_3 = Element.GetParameterValueByName(element=code_block_7.out0, parameterName=code_block_8)
code_block_9 = CodeBlock { "ADSK_Тип элемента КМ"; }
getParameterValueByName_4 = Element.GetParameterValueByName(element=code_block_2, parameterName=code_block_9)
code_block_10 = CodeBlock(kss_list=getParameterValueByName_4) { kss_list==""; }
filterByBoolMask_6 = List.FilterByBoolMask(list=code_block_2, mask=code_block_10)
filterByBoolMask_7 = List.FilterByBoolMask(list=getParameterValueByName_4, mask=code_block_10)
code_block_11 = CodeBlock(kss_list=filterByBoolMask_7.out) { kss_list>1; }
filterByBoolMask_8 = List.FilterByBoolMask(list=filterByBoolMask_6.out, mask=code_block_11)
code_block_12 = CodeBlock(list1=filterByBoolMask_8.in) { List.Flatten(list1, 1); }
join = List.Join(code_block_7.out1, code_block_12)
code_block_13 = CodeBlock { "ADSK_Наименование профиля"; }
getParameterValueByName_5 = Element.GetParameterValueByName(element=code_block_7.out0, parameterName=code_block_13)
code_block_14 = CodeBlock { "ADSK_Наименование профиля"; }
getParameterValueByName_6 = Element.GetParameterValueByName(element=code_block_12, parameterName=code_block_14)
join_2 = List.Join(getParameterValueByName_5, getParameterValueByName_6)
groupByKey = List.GroupByKey(list=join, keys=join_2)
code_block_15 = CodeBlock { "Материал несущих конструкций"; }
getParameterValueByName_7 = Element.GetParameterValueByName(element=code_block_7.out1, parameterName=code_block_15)
code_block_16 = CodeBlock { "ADSK_Материал"; }
getParameterValueByName_8 = Element.GetParameterValueByName(element=code_block_12, parameterName=code_block_16)
join_3 = List.Join(getParameterValueByName_7, getParameterValueByName_8)
groupByKey_2 = List.GroupByKey(list=join_3, keys=join_2)
groupByKey_3 = List.GroupByKey(list=groupByKey.groups@L2, keys=groupByKey_2.groups@L2)
code_block_17 = CodeBlock { "ADSK_Наименование"; }
getParameterValueByName_9 = Element.GetParameterValueByName(element=code_block_7.out0, parameterName=code_block_17)
code_block_18 = CodeBlock { "ADSK_Наименование краткое"; }
getParameterValueByName_10 = Element.GetParameterValueByName(element=code_block_12, parameterName=code_block_18)
join_4 = List.Join(getParameterValueByName_9, getParameterValueByName_10)
groupByKey_4 = List.GroupByKey(list=join_4, keys=join_2)
groupByKey_5 = List.GroupByKey(list=groupByKey_4.groups@L2, keys=groupByKey_2.groups@L2)
groupByKey_6 = List.GroupByKey(list=groupByKey_3.groups@L2, keys=groupByKey_5.groups@L2)
code_block_19 = CodeBlock(kss_list=groupByKey_6.groups) { List.Flatten(kss_list@@-3<1>, 1); }
code_block_20 = CodeBlock { "Изображение"; }
element_types = ElementTypes("ImageType")
all_elements_of_type = ElementsOfType(element_types)
code_block_21 = CodeBlock { "Ширина (в пикселах)"; }
getParameterValueByName_11 = Element.GetParameterValueByName(element=all_elements_of_type, parameterName=code_block_21)
code_block_22 = CodeBlock(kss_list=getParameterValueByName_11) { kss_list==1; }
filterByBoolMask_9 = List.FilterByBoolMask(list=all_elements_of_type, mask=code_block_22)
code_block_23 = CodeBlock { "Высота (в пикселах)"; }
getParameterValueByName_12 = Element.GetParameterValueByName(element=filterByBoolMask_9.in, parameterName=code_block_23)
code_block_24 = CodeBlock(kss_list=getParameterValueByName_12) { (kss_list-17)/23+1; }
count = Count(groupByKey_6.unique_keys@L2)
code_block_25 = CodeBlock(kss_list=count) { kss_list/1; }
allIndicesOf = List.AllIndicesOf(list=code_block_24, item=code_block_25)
getItemAtIndex = List.GetItemAtIndex(list=filterByBoolMask_9.in, index=allIndicesOf)
code_block_26 = CodeBlock { 1; }
flatten = List.Flatten(list=getItemAtIndex, amt=code_block_26)
count_2 = Count(code_block_19@L2)
cycle = List.Cycle(list=flatten, amount=count_2, lacing=Longest)
setParameterByName = Element.SetParameterByName(element=code_block_19, parameterName=code_block_20, value=cycle)
code_block_27 = CodeBlock(kss_list=code_block_25) { kss_list==1?true:false; }
filterByBoolMask_10 = List.FilterByBoolMask(list=groupByKey_6.groups, mask=code_block_27)
code_block_28 = CodeBlock(kss_list=filterByBoolMask_10.in) { List.Flatten(kss_list@@-3<1>, 1); }
code_block_29 = CodeBlock { "Изображение для СМП"; }
filterByBoolMask_11 = List.FilterByBoolMask(list=code_block_25, mask=code_block_27)
getItemAtIndex_2 = List.GetItemAtIndex(list=filterByBoolMask_9.in, index=filterByBoolMask_11.in)
code_block_30 = CodeBlock { 1; }
flatten_2 = List.Flatten(list=getItemAtIndex_2, amt=code_block_30)
count_3 = Count(code_block_28@L2)
cycle_2 = List.Cycle(list=flatten_2, amount=count_3, lacing=Longest)
setParameterByName_2 = Element.SetParameterByName(element=code_block_28, parameterName=code_block_29, value=cycle_2)
code_block_31 = CodeBlock(kss_list=filterByBoolMask_10.out) { List.Flatten(kss_list@@-3<1>, 1); }
code_block_32 = CodeBlock { "Изображение для СМП"; }
code_block_33 = CodeBlock { 0; }
getItemAtIndex_3 = List.GetItemAtIndex(list=filterByBoolMask_9.in, index=code_block_33)
code_block_34 = CodeBlock { 1; }
flatten_3 = List.Flatten(list=getItemAtIndex_3, amt=code_block_34)
count_4 = Count(code_block_31@L2)
cycle_3 = List.Cycle(list=flatten_3, amount=count_4, lacing=Longest)
setParameterByName_3 = Element.SetParameterByName(element=code_block_31, parameterName=code_block_32, value=cycle_3)
