# Dynamo graph PGS_СС_МаркировкаОборудования.dyn (Dynamo 2.10.1.3976)

выберите_элементы_в_модели = DSModelElementsSelection()  # "Выберите элементы в модели (рамкой выбора)"; nothing selected; graph input
ADSK_Позиция = CodeBlock { "ADSK_Позиция"; }
марка_по_умолчанию = StringInput("default")  # graph input
N1 = IntegerSlider(1, range=1..100 step 1)  # graph input
N2 = IntegerSlider(1, range=1..100 step 1)  # graph input
N3 = IntegerSlider(1, range=1..1000 step 1)  # graph input
ADSK_Позиция_2 = CodeBlock { "RBZ_Количество занимаемых адресов"; }
наличие_букв = BoolSelector(true)  # graph input
наличие_n1 = BoolSelector(true)  # graph input
наличие_n2 = BoolSelector(true)  # graph input
назначение_марки_элементам = Python(IN[0]=выберите_элементы_в_модели, IN[1]=ADSK_Позиция, IN[2]=марка_по_умолчанию, IN[3]=N1, IN[4]=N2, IN[5]=N3, IN[6]=ADSK_Позиция_2, IN[7]=наличие_букв, IN[8]=наличие_n1, IN[9]=наличие_n2)  # IronPython2; graph output
# ---------- назначение_марки_элементам.python (109 lines) ----------
import clr
clr.AddReference('ProtoGeometry')
from Autodesk.DesignScript.Geometry import *
# Import ToDSType(bool) extension method
clr.AddReference("RevitNodes")
import Revit
clr.ImportExtensions(Revit.Elements)
# Import geometry conversion extension methods
clr.ImportExtensions(Revit.GeometryConversion)
# Import DocumentManager and TransactionManager
clr.AddReference("RevitServices")
import RevitServices
from RevitServices.Persistence import DocumentManager
from RevitServices.Transactions import TransactionManager
from System.Collections.Generic import *
# Import RevitAPI
clr.AddReference("RevitAPI")
import Autodesk
from Autodesk.Revit.DB import *

doc = DocumentManager.Instance.CurrentDBDocument

# Выбранные элементы
elements = UnwrapElement(IN[0])

_parameter = IN[1] # Название параметра "ADSK_Позиция"
_default = IN[2] # Текстовое значение вместо ADSK_Позиция по умолчанию

_n1 = IN[3] # Значение первой цифры n1
_n2 = IN[4] # Значение второй цифры n2
_n3 = IN[5] # Стартовый номер n3

n3 = [] # Массив номеров оборудования

isText = IN[7] # Добавлять ли 
isN1 = IN[8]
isN2 = IN[9]

# Вывод результата заполнения марок элементов
types = [] # Буквенное обозначение извещателя
marks = [] # Список итоговых марок оборудования

listCountOfAddresses = [] # Список количеств занимаемх адресов
_parameterAddress = IN[6] # Название параметра "RBZ_Количество занимаемых адресов"

# Заполнение списка типов извещателей
for element in elements:
	value = ""
	if (element.LookupParameter(_parameter) == None):
		try:
			value = doc.GetElement(element.GetTypeId()).LookupParameter(_parameter).AsValueString()
		except AttributeError:
			value = _default
	else:
		value = element.LookupParameter(_parameter).AsValueString()
	types.append(value)

# Заполнение списка количеств занимаемых адресов
for element in elements:
	value = 1
	if (element.LookupParameter(_parameterAddress) == None):
		try:
			value = doc.GetElement(element.GetTypeId()).LookupParameter(_parameterAddress).AsDouble()
		except AttributeError:
			value = 1
	else:
		value = element.LookupParameter(_parameter).AsDouble()
	listCountOfAddresses.append(value)


# Заполнение списка значений n3 для назначения элементам
i = 0
j = _n3
while i < len(types):
	_s = str(int(j))
	if listCountOfAddresses[i] > 1:
		_s += ".." + str(int(j + listCountOfAddresses[i] - 1))
	n3.append(_s)
	j += listCountOfAddresses[i]
	i += 1

# Заполнение списка марок для назначения элементам
i = 0
while i < len(types):
	_s = ""
	if (isText):
		_s += str(types[i]) + " "
	if (isN1):
		_s += str(_n1) + "."
	if (isN2):
		_s += str(_n2) + "."
	_s += str(n3[i])
	marks.append(_s)
	i += 1

TransactionManager.Instance.EnsureInTransaction(doc)
out = []
i = 0
while i < len(elements):
	try:
		elements[i].LookupParameter("Марка").Set(marks[i])
		out.append(marks[i])
	except AttributeError:
		out.append("У элемента нет Марки")
	i += 1
TransactionManager.Instance.TransactionTaskDone()


OUT = types, listCountOfAddresses, marks, out
# ----------------------------------------
описание_скрипта = StringInput("""    Скрипт сделан для заполнения параметра "Марка" у элементов раздела СС в формате: AAAn1.n2.n3 . Наличие буквенного значения, n1, n2 также задается. Присутствует функция назначения стартового значения n3. Значения n1, n2 задаются в ручную.

    Из параметра "ADSK_Позиция" (из типа или экземпляра) берется значение AAA, если параметр отсутствует и в типе и в экземпляре, то берется значение default. 
    Если параметр "ADSK_Позиция" не будет заполнен, тоберется пустая строка.""")  # graph input
