# Dynamo graph PGS_Добавление префикса листам.dyn (Dynamo 2.3.0.5885)

categories = Categories("OST_Sheets")
all_elements_of_category = ElementsOfCategory(Category=categories)
string = StringInput("Имя листа")
string_2 = StringInput("Имя листа")
getParameterValueByName = Element.GetParameterValueByName(element=all_elements_of_category, parameterName=string_2)
code_block = CodeBlock { 0; }
префикс_наименования_листа = StringInput("Смотровая площадка \"Причальная\".")  # graph input
insert = String.Insert(str=getParameterValueByName, index=code_block, toInsert=префикс_наименования_листа)
setParameterByName = Element.SetParameterByName(element=all_elements_of_category, parameterName=string, value=insert)
