# Dynamo graph PGS_Замена текста в имени вида.dyn (Dynamo 2.10.1.3976)

categories = Categories("OST_Sheets")
all_elements_of_category = ElementsOfCategory(Category=categories)
string = StringInput("Имя листа")
string_2 = StringInput("Имя листа")
getParameterValueByName = Element.GetParameterValueByName(element=all_elements_of_category, parameterName=string_2)
что_удалить_из_названия = StringInput("")  # graph input
на_что_заменить = StringInput("")  # graph input
replace = String.Replace(string=getParameterValueByName, searchFor=что_удалить_из_названия, replaceWith=на_что_заменить)
setParameterByName = Element.SetParameterByName(element=all_elements_of_category, parameterName=string, value=replace)
