# Dynamo graph PGS_МассивКолоннПоКривой.dyn (Dynamo 2.10.1.3976)

# group: Выбор кривой модели
выберите_линию_модели = DSModelElementSelection()  # nothing selected; graph input

# group: Шаг колонн (мм)
шаг_колонн = DoubleInput(3500)  # graph input

# group: Получение опорных точек кривой
curves = Element.Curves(element=выберите_линию_модели)
startPoint = Curve.StartPoint(curve=curves)
pointsAtSegmentLengthFromPoint = Curve.PointsAtSegmentLengthFromPoint(curve=curves, point=startPoint, segmentLength=шаг_колонн)
list_create = List.Create(item0=startPoint, item1=pointsAtSegmentLengthFromPoint)
flatten = List.Flatten(list=list_create)

# group: Высота колонн (мм)
высота_колонн = DoubleInput(3000)  # graph input

# group: Создание колонн
byCoordinates = Vector.ByCoordinates(z=высота_колонн)
byStartPointDirectionLength = Line.ByStartPointDirectionLength(startPoint=flatten, direction=byCoordinates, length=высота_колонн)
levels = Levels("L01 +0.000")
выбор_семейства_колонн = FamilyTypes("210_Прямоугольного сечения (НесКол_2ур):450 x 600 мм")  # graph input
columnByCurve = StructuralFraming.ColumnByCurve(curve=byStartPointDirectionLength, level=levels, structuralColumnType=выбор_семейства_колонн)

# group: Получение векторов нормалей в опорных точках
parameterAtPoint = Curve.ParameterAtPoint(curve=curves)  # unwired: point
список_параметров_точек = Map(list=flatten, f_x=parameterAtPoint)
list_create_2 = List.Create(item0=curves)

# group: Получение списка углов поворота в опорных точках
XAxis = Vector.XAxis()
list_create_3 = List.Create(item0=XAxis)
count = List.Count(list=список_параметров_точек)
cycle = List.Cycle(list=list_create_3, amount=count)
ZAxis = Vector.ZAxis()

# group (continued): Получение векторов нормалей в опорных точках
cycle_2 = List.Cycle(list=list_create_2, amount=count)
normalAtParameter = Curve.NormalAtParameter(curve=cycle_2, param=список_параметров_точек)
list_create_4 = List.Create(item0=normalAtParameter)

# group (continued): Получение списка углов поворота в опорных точках
angleAboutAxis = Vector.AngleAboutAxis(vector=cycle, otherVector=list_create_4, rotationAxis=ZAxis)
angleOfRotation = CodeBlock(AngleOfRotation=angleAboutAxis) { -AngleOfRotation; }
flatten_2 = List.Flatten(list=angleOfRotation)

# group: Поворот колонн
code_block = CodeBlock { "Угол поворота поперечного сечения"; }
setParameterByName = Element.SetParameterByName(element=columnByCurve, parameterName=code_block, value=flatten_2)
getParameterValueByName = Element.GetParameterValueByName(element=columnByCurve, parameterName=code_block)
