# Dynamo graph PGS_ТелоИзЭлемента.dyn "PGS_SolidFromObject" (Dynamo 2.10.1.3976)

# note: Описание проекта и назначение программы Dynamo

# group: ИМПОРТ
# note: Используйте этот цвет группы для узлов, применяемых с целью импорта геометрии.

# group: ВЫВОД
# note: Используйте этот цвет группы для узлов, применяемых с целью создания элементов Revit.

# group: PYTHON
# note: Используйте этот цвет группы для узлов Python и других узлов, связанных со сценарием.

# group: ВХОДНЫЕ ДАННЫЕ
# note: Используйте этот цвет группы для входных данных программ (регуляторы, блоки кода и т.д.).

# group: ПРОЕКТ
# note: Используйте этот цвет группы для функций программы.

# group: Выбранный элемент
выберите_элемент_модели = DSModelElementSelection()  # nothing selected; graph input
описание_скрипта = StringInput("""1. Скрипт создает семейство обобщенной модели по форме выбранного элемента и размещает его экземпляр в то же место, что и у выбранного элемента.
2. Семейства в диспетчере проекта в разщделе обобщенные модели с префиксом Dynamo.
3.1. Если форма выделенного элемента уже создавалась, семейства не будут дублироваться, и разместится уже созданное.
3.2. Если эта форма повернута относительно самого первого созданного семейства, то размещенное семейство необходимо довернуть РУЧНУЮ (пока так).""")  # graph input

# group: Получение категории элемента
code_block = CodeBlock { "Категория"; }
getParameterValueByName = Element.GetParameterValueByName(element=выберите_элемент_модели, parameterName=code_block)

# group: Преобразование габаритов геометрии элемента для метрической системы
geometry = Element.Geometry(element=выберите_элемент_модели)
byUnion = Solid.ByUnion(solids=geometry)
code_block_2 = CodeBlock { 0.3048; }
scale = Geometry.Scale(geometry=byUnion, amount=code_block_2)

# group: Получение объема элемента
volume = Solid.Volume(solid=byUnion)
code_block_3 = CodeBlock(value=volume) { (value+0)/1000000000; }
code_block_4 = CodeBlock { 3; }
round = Math.Round(number=code_block_3, digits=code_block_4)

# group: Исходные параметря для создания семейства обобщенной модели по форме заданного элемента с названием Dynamo_КатегорияЭлемента_ОбъемЭлемента
code_block_5 = CodeBlock(ElementCategory=getParameterValueByName, ElementVolume=round) { "Dynamo_"+ElementCategory+"_"+ElementVolume; }
categories = Categories("OST_GenericModel")
file_path = Filename("C:\ProgramData\Autodesk\RVT 2022\Family Templates\Russian\Метрическая система, типовая модель.rft")

# group: Определяет, существует ли в проекте семейство Dynamo_КатегорияВыбранногоЭлемента_ОбъемВыбранногоЭлемента
element_types = ElementTypes("Family")
all_elements_of_type = ElementsOfType(element_type=element_types)
string_from_object = FromObject(object=all_elements_of_type)
code_block_6 = CodeBlock { 0; 8; }
remove = String.Remove(string=string_from_object, startIndex=code_block_6.out0, count=code_block_6.out1)
contains = String.Contains(str=remove, searchFor=code_block_5, lacing=Longest)
filterByBoolMask = List.FilterByBoolMask(list=remove, mask=contains)
true_если_семейства_нет = List.IsEmpty(list=filterByBoolMask.in)

# group: "Переключатель" создания семейства. Если в проекте уже существует семейство с заданным именем, откроется редактор семейств, который можно закрыть и не сохранять семейство
code_block_7 = CodeBlock { null; }
true_семейства_нет_false = If(test=true_если_семейства_нет, true=scale, false=code_block_7)  # "true - семейства нет; false - семейство есть"

# group: Выбор из материалов проекта "воздух"
categories_2 = Categories("OST_Materials")
all_elements_of_category = ElementsOfCategory(Category=categories_2)
code_block_8 = CodeBlock { "Имя"; }
getParameterValueByName_2 = Element.GetParameterValueByName(element=all_elements_of_category, parameterName=code_block_8)
code_block_9 = CodeBlock { "воздух"; }
contains_2 = String.Contains(str=getParameterValueByName_2, searchFor=code_block_9)
filterByBoolMask_2 = List.FilterByBoolMask(list=all_elements_of_category, mask=contains_2)
code_block_10 = CodeBlock { 20; }
flatten = List.Flatten(list=filterByBoolMask_2.in, amt=code_block_10)
code_block_11 = CodeBlock { 0; }
getItemAtIndex = List.GetItemAtIndex(list=flatten, index=code_block_11)

# group: Создание семейства
byGeometry = FamilyType.ByGeometry(solidGeometry=true_семейства_нет_false, name=code_block_5, category=categories, templatePath=file_path, material=getItemAtIndex)

# group: Выбор из семейств проекта семейства "Dynamo_НазваниеКатегории_ОбъемЭлемента"
element_types_2 = ElementTypes("Family")
all_elements_of_type_2 = ElementsOfType(element_type=element_types_2)
string_from_object_2 = FromObject(object=all_elements_of_type_2)
contains_3 = String.Contains(str=string_from_object_2, searchFor=code_block_5, lacing=Longest)
filterByBoolMask_3 = List.FilterByBoolMask(list=all_elements_of_type_2, mask=contains_3)
code_block_12 = CodeBlock { 20; }
flatten_2 = List.Flatten(list=filterByBoolMask_3.in, amt=code_block_12)
code_block_13 = CodeBlock { 0; }
getItemAtIndex_2 = List.GetItemAtIndex(list=flatten_2, index=code_block_13)
byFamilyAndName = FamilyType.ByFamilyAndName(family=getItemAtIndex_2, name=code_block_5)

# group: FamilyType для данного элемента с учетом уже созданных семейств
true_семейства_нет_false_2 = If(test=true_если_семейства_нет, true=byGeometry, false=byFamilyAndName)  # "true - семейства нет; false - семейство есть"

# group: Размещение DynamoСемейства возле выбранного элемента
centroid = Solid.Centroid(solid=byUnion)
byPoint = FamilyInstance.ByPoint(familyType=true_семейства_нет_false_2, point=centroid)

# group: Перемещение экземпляра DynamoСемейства по выбранному элементу
geometry_2 = Element.Geometry(element=byPoint)
centroid_2 = Solid.Centroid(solid=geometry_2)
byTwoPoints = Vector.ByTwoPoints(start=centroid_2, end=centroid)
moveByVector = Element.MoveByVector(element=byPoint, vector=byTwoPoints)
